# Grasshopper definition MIS_example.gh (Grasshopper 1.0.8)

# ---- group: construct example
pt = ConstructPoint(XCoordinate=0, YCoordinate=0, ZCoordinate=0)
Y = UnitY(Factor=1)
line = LineSDL(Start=pt, Direction=Y, Length=10)
X = UnitX(Factor=1)
arrlinear = LinearArray(Geometry=line, Direction=X, Count=7)  # -> Geometry, Transform

# ----
distance_constraint = Panel("1.5")

# ---- group: optional
keep_line = ListItem(List=arrlinear.Geometry, Index=1, Wrap=True)

# ----
# Important!: 1. Set to List access for "curves" and "keep". And set Type-hint to "curve"
# 
# 2. Set to Item access for "dist". And set Type-hint to "float"
py3 = Python3Script(curves=arrlinear.Geometry, dist=distance_constraint)  # -> kept, removed; inputs curves: list of Curve, dist: Double, keep: list of Curve
# ---------- py3: Python ----------
from Curve_Removal import MIS_curves

kept, removed = MIS_curves.main(curves, dist, keep)
# ---------- end py3 ----------
crv = Curve(py3.removed)
crv_2 = Curve(py3.kept)
