# Grasshopper definition PSL_TracerABC_example.gh (Grasshopper 1.0.8)
# plug-ins: Karamba3D, Pufferfish, eleFront

crv = Curve(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)
explode = Explode(Curve=crv, Recursive=True)  # -> Segments, Vertices
boundary = BoundarySurfaces(Edges=crv)
disc = Discontinuity(Curve=crv, Level=1)  # -> Points, Parameters
crv_2 = Curve(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)
midpt = CurveMiddle(Curve=explode.Segments)
mesh_uv = MeshSurface(Surface=boundary, UCount="80", VCount="80", Overhang=True, Equalize=False)
crv_cp = CurveClosestPoint(Point=midpt, Curve=explode.Segments)  # -> Point, Parameter, Distance
explode_2 = Explode(Curve=crv_2, Recursive=True)  # -> Segments, Vertices
boundary_2 = BoundarySurfaces(Edges=crv_2)
disc_2 = Discontinuity(Curve=crv_2, Level=1)  # -> Points, Parameters
shatter = Shatter(Curve=explode.Segments, Parameters=crv_cp.Parameter)
midpt_2 = CurveMiddle(Curve=explode_2.Segments)
mesh_uv_2 = MeshSurface(Surface=boundary_2, UCount="80", VCount="80", Overhang=True, Equalize=False)
crv_cp_2 = CurveClosestPoint(Point=midpt_2, Curve=explode_2.Segments)  # -> Point, Parameter, Distance
item = ListItem(List=shatter, Index=0, Wrap=True)

medges = MeshEdges(Mesh=mesh_uv)  # -> NakedEdges, InteriorEdges, NonManifoldEdges
nv = NakedVertices(Mesh=mesh_uv)  # -> ClothedIndex, NakedIndex, ClothedPts, NakedPts
vertexloads = VertexLoads(Mesh=mesh_uv, Strength="-0.0000001")
crv_3 = Curve(medges.InteriorEdges)
anchor = Anchor(Point=nv.NakedPts, Strength=10000)
len = Length(Curve=crv_3)
show = Show(G=mesh_uv)
multiplication = Multiplication(A=len, B=Slider(0.27, range=0..0.9))
length_line = LengthLine(Line=crv_3, Length=multiplication, Strength=10)
entwine = Entwine(Branch00=show, Branch01=length_line, Branch02=anchor, Branch03=vertexloads, FlattenInputs=True)

shatter_2 = Shatter(Curve=explode_2.Segments, Parameters=crv_cp_2.Parameter)
divlength = DivideLength(Curve=item, Length="5")  # -> Points, Tangents, Parameters
item_2 = ListItem(List=shatter_2, Index=0, Wrap=True)

medges_2 = MeshEdges(Mesh=mesh_uv_2)  # -> NakedEdges, InteriorEdges, NonManifoldEdges
nv_2 = NakedVertices(Mesh=mesh_uv_2)  # -> ClothedIndex, NakedIndex, ClothedPts, NakedPts
vertexloads_2 = VertexLoads(Mesh=mesh_uv_2, Strength="-0.1")
crv_4 = Curve(medges_2.InteriorEdges)
anchor_2 = Anchor(Point=nv_2.NakedPts, Strength=10000)
len_2 = Length(Curve=crv_4)
show_2 = Show(G=mesh_uv_2)
multiplication_2 = Multiplication(A=len_2, B=Slider(0.27, range=0..0.9))
length_line_2 = LengthLine(Line=crv_4, Length=multiplication_2, Strength=10)
entwine_2 = Entwine(Branch00=show_2, Branch01=length_line_2, Branch02=anchor_2, Branch03=vertexloads_2, FlattenInputs=True)

divlength_2 = DivideLength(Curve=item_2, Length="5")  # -> Points, Tangents, Parameters
solver = Solver(GoalObjects=entwine, Reset=Button(), Threshold=1e-15, Tolerance=0.0001, On=Toggle(False))  # -> I, V, O
formfound_mesh = ExplodeTree(Data=solver.O)
solver_2 = Solver(GoalObjects=entwine_2, Reset=Button(), Threshold=1e-15, Tolerance=0.0001, On=Toggle(False))  # -> I, V, O
dam = DataDam(DataA=formfound_mesh, BufferDelay=10000000, BufferMode=0)
formfound_mesh_2 = ExplodeTree(Data=solver_2.O)
mesh = Mesh(dam)
dam_2 = DataDam(DataA=formfound_mesh_2, BufferDelay=10000000, BufferMode=0)
mesh_2 = Mesh(dam_2)

number_slider = Slider(-2, range=-10..0)
nv_3 = NakedVertices(Mesh=mesh)  # -> ClothedIndex, NakedIndex, ClothedPts, NakedPts
Z = UnitZ(Factor="-0.1")
matprops = MaterialPropertiesKaramba3D(
    FamilyOfMaterial="Steel",
    Name="S235",
    YoungsModulus_kN_cm²="3",
    InPlaneShearModulus_kN_cm²="1.4",
    TransverseShearModulus_kN_cm²="1.4",
    SpecificWeight_kN_m³="1",
    CoefficientOfThermalExpansion_1=1.2e-05,
    TensileStrength_kN_cm²=23.5,
    CompressiveStrength_kN_cm²=-23.5,
    StrengthHypothesis="MISES",
    mode="Isotrop")
supp = SupportKaramba3D(PosInd=nv_3.NakedPts, Ct_kN_m=Vector(0, 0, 0), Cr_kNm_rad=Vector(0, 0, 0), menu=[buttons(on, on, on, off, off, off)])
loads = LoadsKaramba3D(Vector=Z, Mesh=mesh, LCase="LC0", mode="MeshLoad -Const.", menu=[buttons(off, on, off), buttons(on, on)])
loads_2 = LoadsKaramba3D(Eps0="-2", LCase="LC0", mode="InitialStrain")
crosec = CrossSectionKaramba3D(FamilyNameOfCrossSection="DefaultCroSec", Material=matprops, Height_cm="0.3", mode="Shell - Const")
load = LoadKaramba3D([loads, loads_2])
surfelem = CreateSurfaceElementKaramba3D(Mesh=mesh, CrossSection=crosec, LimitDistance_m=0.005, Bending=False, mode="MeshToMembrane")  # -> Element, Points, Info
assemble = AssembleModelKaramba3D(Elem=flatten(surfelem.Element), Support=flatten(supp), Load=flatten(load), LimitDistance_cm=0.005)  # -> Model, Info, Mass_kg, CentreOfGravity, LoadCaseNames

nv_4 = NakedVertices(Mesh=mesh_2)  # -> ClothedIndex, NakedIndex, ClothedPts, NakedPts
Z_2 = UnitZ(Factor=Slider(-2, range=-10..0))
matprops_2 = MaterialPropertiesKaramba3D(
    FamilyOfMaterial="Steel",
    Name="S235",
    YoungsModulus_kN_cm²="3",
    InPlaneShearModulus_kN_cm²="1.4",
    TransverseShearModulus_kN_cm²="1.4",
    SpecificWeight_kN_m³="1",
    CoefficientOfThermalExpansion_1=1.2e-05,
    TensileStrength_kN_cm²=23.5,
    CompressiveStrength_kN_cm²=-23.5,
    StrengthHypothesis="MISES",
    mode="Isotrop")
supp_2 = SupportKaramba3D(PosInd=nv_4.NakedPts, Ct_kN_m=Vector(0, 0, 0), Cr_kNm_rad=Vector(0, 0, 0), menu=[buttons(on, on, on, off, off, off)])
loads_3 = LoadsKaramba3D(Vector=Z_2, Mesh=mesh_2, LCase="LC0", mode="MeshLoad -Const.", menu=[buttons(off, on, off), buttons(on, on)])
loads_4 = LoadsKaramba3D(Eps0="-2", LCase="LC0", mode="InitialStrain")
crosec_2 = CrossSectionKaramba3D(FamilyNameOfCrossSection="DefaultCroSec", Material=matprops_2, Height_cm="0.3", mode="Shell - Const")
load_2 = LoadKaramba3D([loads_3, loads_4])
surfelem_2 = CreateSurfaceElementKaramba3D(Mesh=mesh_2, CrossSection=crosec_2, LimitDistance_m=0.005, Bending=False, mode="MeshToMembrane")  # -> Element, Points, Info
assemble_2 = AssembleModelKaramba3D(Elem=flatten(surfelem_2.Element), Support=flatten(supp_2), Load=flatten(load_2), LimitDistance_cm=0.005)  # -> Model, Info, Mass_kg, CentreOfGravity, LoadCaseNames

panel = Panel("-0.1")
analysethii = AnalyseThIIKaramba3D(
    Model=assemble.Model,
    UseInitialNII=True,
    NIIFromCombination=True,
    NoTensionalNII=False,
    RTolerance=1e-07,
    MaxIterations=50)  # -> AnalysedModel, MaximumDisplacement_cm, ResultingForce_kN, ChangeOfElasticEnergy_kNm
analysethii_2 = AnalyseThIIKaramba3D(
    Model=assemble_2.Model,
    UseInitialNII=True,
    NIIFromCombination=True,
    NoTensionalNII=False,
    RTolerance=1e-07,
    MaxIterations=50)  # -> AnalysedModel, MaximumDisplacement_cm, ResultingForce_kN, ChangeOfElasticEnergy_kNm
s_forces = ShellForcesKaramba3D(AnalysedModel=analysethii.AnalysedModel, mode="Principal")  # -> Model, expr("x*100", flatten(FirstPrincipalNormalForce_kN_m)), expr("x*100", flatten(SecondPrincipalNormalForce_kN_m)), FirstPrincipalMoment_kNm_m, SecondPrincipalMoment_kNm_m, ShearForceInLocalXDirection_kN_m, ShearForceInLocalYDirection_kN_m, LoadCaseIndex
modelview = ModelViewKaramba3D(Model=analysethii.AnalysedModel)  # -> Model, DeformedMesh, DeformedAxes, DeformedModel, MaximumDeformation
shellview = ShellViewKaramba3D(Model=analysethii.AnalysedModel, IndexOfLayer=0)  # -> Model, MeshesOfRenderedShells, LegendColours, LegendTags
s_forces_2 = ShellForcesKaramba3D(AnalysedModel=analysethii_2.AnalysedModel, mode="Principal")  # -> Model, expr("x*100", flatten(FirstPrincipalNormalForce_kN_m)), expr("x*100", flatten(SecondPrincipalNormalForce_kN_m)), FirstPrincipalMoment_kNm_m, SecondPrincipalMoment_kNm_m, ShearForceInLocalXDirection_kN_m, ShearForceInLocalYDirection_kN_m, LoadCaseIndex
modelview_2 = ModelViewKaramba3D(Model=analysethii_2.AnalysedModel)  # -> Model, DeformedMesh, DeformedAxes, DeformedModel, MaximumDeformation
shellview_2 = ShellViewKaramba3D(Model=analysethii_2.AnalysedModel, IndexOfLayer=0)  # -> Model, MeshesOfRenderedShells, LegendColours, LegendTags
bnd = Bounds(Numbers=s_forces.FirstPrincipalNormalForce_kN_m)
legend = Legend(
    Colour=shellview.LegendColours,
    Tags=shellview.LegendTags,
    Rectangle={Plane=PlaneXY(346, 100, 0), Size=Domain2(u=-25..25, v=-100..100)},
    LegendType=1)
bnd_2 = Bounds(Numbers=s_forces_2.FirstPrincipalNormalForce_kN_m)
legend_2 = Legend(
    Colour=shellview_2.LegendColours,
    Tags=shellview_2.LegendTags,
    Rectangle={Plane=PlaneXY(70, -35, 0), Size=Domain2(u=-7..7, v=-30..30)},
    LegendType=1)
shellvecresults = ResultVectorsOnShellsKaramba3D(Model=analysethii.AnalysedModel, LayerPosition=0, mode="PrincStress")  # -> Model, Points, FirstPrincipalStressVector_kN_cm², SecondPrincipalStressVector_kN_cm², FirstPrincipalStressValue_kN_cm², SecondPrincipalStressValue_kN_cm²
textdot = DefineTextDot(Text=s_forces.FirstPrincipalNormalForce_kN_m, Location=shellvecresults.Points, Font="Arial", Size=9)
crv_5 = Curve([<curve referenced from the Rhino model> x4])
shellvecresults_2 = ResultVectorsOnShellsKaramba3D(Model=analysethii_2.AnalysedModel, LayerPosition=0, mode="PrincStress")  # -> Model, Points, FirstPrincipalStressVector_kN_cm², SecondPrincipalStressVector_kN_cm², FirstPrincipalStressValue_kN_cm², SecondPrincipalStressValue_kN_cm²
textdot_2 = DefineTextDot(Text=s_forces_2.FirstPrincipalNormalForce_kN_m, Location=shellvecresults_2.Points, Font="Arial", Size=9)
mesh_3 = Mesh(mesh)
md_slider = MDSlider(
    SliderMode=0,
    slider_value=Point(0.05455947504, 0.0690794999, 0.5),
    x_domain=Domain(0, 1),
    y_domain=Domain(0, 1),
    z_domain=Domain(0, 1))
divide = DivideCurve(Curve=crv_5, Count=8, Kinks=False)  # -> flatten(Points), Tangents, Parameters
divdist = DivideDistance(Curve=crv_5, Distance=4)  # -> Points, Tangents, Parameters
crv_6 = Curve([<curve referenced from the Rhino model> x4])
msh2psrf = MeshToPolysurface(Mesh=mesh_3, Triangles=False, FaceMerge=False)
mesh_4 = Mesh(mesh_2)
cullpt = CullDuplicates(Points=divdist.Points, Tolerance=0.1, CullMode=3)  # -> Points, Indices, Valence
md_slider_2 = MDSlider(
    SliderMode=0,
    slider_value=Point(0.05573849562, 0.4963306799, 0.5),
    x_domain=Domain(0, 1),
    y_domain=Domain(0, 1),
    z_domain=Domain(0, 1))
divide_2 = DivideCurve(Curve=crv_6, Count=8, Kinks=False)  # -> flatten(Points), Tangents, Parameters
evalsrf = EvaluateSurface(Surface=reparameterize(msh2psrf), Point=md_slider)  # -> Point, Normal, UDirection, VDirection, Frame
project = ProjectPoint(Point=cullpt.Points, Direction=Vector(0, 0, -1), Geometry=msh2psrf)  # -> Point, Index
divdist_2 = DivideDistance(Curve=crv_6, Distance=4)  # -> Points, Tangents, Parameters
msh2psrf_2 = MeshToPolysurface(Mesh=mesh_4, Triangles=False, FaceMerge=False)
null = NullItem(Item=project.Point)  # -> NullFlags, InvalidFlags, Description
cullpt_2 = CullDuplicates(Points=divdist_2.Points, Tolerance=0.1, CullMode=3)  # -> Points, Indices, Valence
project_2 = ProjectPoint(Point=evalsrf.Point, Direction=Vector(0, 0, -1), Geometry=msh2psrf)  # -> Point, Index
evalsrf_2 = EvaluateSurface(Surface=reparameterize(msh2psrf_2), Point=md_slider_2)  # -> Point, Normal, UDirection, VDirection, Frame
project_3 = ProjectPoint(Point=cullpt_2.Points, Direction=Vector(0, 0, -1), Geometry=msh2psrf_2)  # -> Point, Index
project_4 = ProjectPoint(Direction=Vector(0, 0, -1))  # -> Point, Index
cir = Circle(Plane=flatten(project_2.Point), Radius=0.5)

popgeo = PopulateGeometry(Geometry=mesh_3, Count=100, Seed=1)
cull = CullPattern(List=project.Point, CullPattern=invert(null.NullFlags))

null_2 = NullItem(Item=project_3.Point)  # -> NullFlags, InvalidFlags, Description
project_5 = ProjectPoint(Point=evalsrf_2.Point, Direction=Vector(0, 0, -1), Geometry=msh2psrf_2)  # -> Point, Index
cull_i = CullIndex(List=cull, Indices=0, Wrap=True)
project_6 = ProjectPoint(Direction=Vector(0, 0, -1))  # -> Point, Index

popgeo_2 = PopulateGeometry(Geometry=mesh_4, Count=100, Seed=1)
cull_2 = CullPattern(List=project_3.Point, CullPattern=invert(null_2.NullFlags))

cir_2 = Circle(Plane=flatten(cull_i), Radius=0.5)
crv_7 = Curve(crv)
explode_3 = Explode(Curve=crv_7, Recursive=True)  # -> Segments, Vertices
cull_i_2 = CullIndex(List=divlength.Points, Indices=[0, -1], Wrap=True)
pt = Point(flatten(cull))
cull_i_3 = CullIndex(List=cull_2, Indices=0, Wrap=True)
lng = ListLength(List=pt)
crv_8 = Curve(crv_2)
shelllineresults = LineResultsOnShellsKaramba3D(
    AnalysedModel=analysethii.AnalysedModel,
    LayerPosition=0,
    ListOfSourcesOfPrincipalStressLinesLinesPoints=cull_i,
    SegmentLength_m=0.5,
    DA_deg=5,
    mode="PrincStress")  # -> Model, Lines1, Lines2
cir_3 = Circle(Plane=flatten(cull_i_3), Radius=0.5)
import_test = Python3Script(
    aa=flatten(project_2.Point),
    bb=shellvecresults.SecondPrincipalStressVector_kN_cm²,
    cc=shellvecresults.Points,
    dd=msh2psrf,
    ee=explode_3.Segments)  # -> psl, connect, valid_seeds; inputs aa: Point3d, bb: list of Vector3d, cc: list of Point3d, dd: Brep, ee: list of Curve
# ---------- import_test: Python ----------
from PSL_Tracer import Tracer_B


#BASIC
h = 0.4                         #Step length
num_steps = 1000                #Max iterations
k = 15                          #Interpolation amount
collision_threshold = 1.5       #Distance constraint
snap_radius = 1                 #Snapping radius
n_back = 5                      #Steps back when merging
offset_distance = 3             #Offset distance
sample_interval = 2             #Sampling for offsets

sample_count = 300              #Sampling boundaries for edge connection 
k_edge = 30                     #Edge connection considerations
ratio_minseed_coll = 1.5        #Ratio between min_seed_distance and collision_threshold   min_seed_distance = collision_threshold * ratio

#Geometric input
seed_point = aa
principal_vectors = bb
points = cc
domain_surface = dd
boundary_curves = ee


psl, connect, valid_seeds= Tracer_B.main(h,num_steps,k,collision_threshold,snap_radius,n_back,offset_distance,sample_interval,sample_count,k_edge,ratio_minseed_coll,seed_point,principal_vectors,points,domain_surface,boundary_curves)
# ---------- end import_test ----------
tracer_automatic_3d_self_single_loop = Python3Script(
    seed_point=project_2.Point,
    principal_vectors=shellvecresults.SecondPrincipalStressVector_kN_cm²,
    points=shellvecresults.Points,
    domain_surface=msh2psrf,
    collision_threshold="6",
    boundary_curves=explode_3.Segments)  # -> psl, connect, valid_seeds; inputs seed_point: Point3d, principal_vectors: list of Vector3d, points: list of Point3d, domain_surface: Brep, collision_threshold: Double, boundary_curves: list of Curve
# ---------- tracer_automatic_3d_self_single_loop: Python ----------
def main(h,num_steps,k,collision_threshold,snap_radius,n_back,offset_distance,sample_interval,sample_count,k_edge,ratio_minseed_coll,seed_point,principal_vectors,points,domain_surface,boundary_curves):

    import math
    import numpy as np
    import rhinoscriptsyntax as rs
    import Rhino.Geometry as rg
    import scriptcontext as sc
    from scipy.spatial import KDTree
    from ghpythonlib import treehelpers as tr


    # ------------------------------------------------------------------------
    # Set variables
    # ------------------------------------------------------------------------
    min_seed_distance = collision_threshold * ratio_minseed_coll
    closing_threshold=h
    boundary_tolerance = h
    seed_boundary_dist = min_seed_distance


    # ------------------------------------------------------------------------
    # Helper functions
    # ------------------------------------------------------------------------
    def build_polyline_curve_3d(poly_pts):
        pts3d = [rg.Point3d(pt[0], pt[1], pt[2]) for pt in poly_pts]
        poly = rg.Polyline(pts3d)
        return rg.PolylineCurve(poly)

    def to_xyz(pt_or_vec):
        """Converts Rhino.Geometry.Point3d or Vector3d (or numeric [x,y,z]) to a Python list [x, y, z]."""
        if hasattr(pt_or_vec, "X"):
            return [pt_or_vec.X, pt_or_vec.Y, pt_or_vec.Z]
        else:
            # Already [x,y,z]
            return [pt_or_vec[0], pt_or_vec[1], pt_or_vec[2]]

    def distance_3d(a, b):
        return math.sqrt((a[0]-b[0])**2 + (a[1]-b[1])**2 + (a[2]-b[2])**2)

    def normalize(vector):
        """Normalize a vector (2D) to unit length."""
        magnitude = math.sqrt(vector[0]**2 + vector[1]**2+vector[2]**2)
        return [vector[0] / magnitude, vector[1] / magnitude,vector[2] / magnitude] if magnitude != 0 else [0, 0, 0]

    def find_closest_neighbors_kd(point, kd_tree, k):
        """
        Given a 2D point (as [x,y]) and a pre-built KDTree,
        return a list of indices of the k closest points.
        """

        distances, indices = kd_tree.query(point,k=k)
        if isinstance(indices, int):
            return [indices]
        return list(indices)

    def is_point_close_to_any(point_list, single_point, threshold):
        flat = [item for sublist in point_list for item in sublist]
        #print(f"single = {single_point}")
        single_point_1 = rg.Point3d(single_point[0],single_point[1],single_point[2])
        
        
        for pt in flat:
            #print(f"pt = {pt}")
            if single_point_1.DistanceTo(pt) <= threshold:
                return pt
        return single_point

    def project_onto_surface(surface, pt3d, tolerance=200):
        pt_rh = rg.Point3d(pt3d[0], pt3d[1], pt3d[2])
        
        if isinstance(surface, rg.Brep):
            # Note the 6 returned values:
            rc, closest_pt, cindex, u, v, normal = surface.ClosestPoint(pt_rh, tolerance)
            if rc:
                # Check if cindex is a face
                if cindex.ComponentIndexType == rg.ComponentIndexType.BrepFace:
                    face_id = cindex.Index
                    face = surface.Faces[face_id]
                    
                    # 'closest_pt' is the 3D point on that face
                    # Optionally confirm it's within the face domain or do face.IsPointOnFace(u,v)
                    
                    return [closest_pt.X, closest_pt.Y, closest_pt.Z]
                else:
                    # The closest component might be an edge or vertex
                    return None
            else:
                return None
        
        elif isinstance(surface, rg.Surface):
            rc, u, v = surface.ClosestPoint(pt_rh)
            if rc:
                pt_srf = surface.PointAt(u, v)
                return [pt_srf.X, pt_srf.Y, pt_srf.Z]
            else:
                return None
        else:
            return None

    def distance_to_brep_edges(pt3d, boundary_curves):
        test_pt = rg.Point3d(pt3d[0], pt3d[1], pt3d[2])
        min_dist = float('inf')
        best_cp = None  # keep track of the closest point so far
        
        for crv in boundary_curves:
            rc, t = crv.ClosestPoint(test_pt)
            if rc:
                cp = crv.PointAt(t)
                dist = cp.DistanceTo(test_pt)
                if dist < min_dist:
                    min_dist = dist
                    best_cp = cp
        
        return min_dist, best_cp

    def is_on_surface(surface, pt3d, tol=0.01):
        """
        Returns True if pt3d is within 'tol' of the surface. 
        """
        if not surface: 
            return True  # no surface provided
        pproj = project_onto_surface(surface, pt3d)
        if pproj is None:
            return False
        dx = pt3d[0] - pproj[0]
        dy = pt3d[1] - pproj[1]
        dz = pt3d[2] - pproj[2]
        dist = math.sqrt(dx*dx + dy*dy + dz*dz)
        return (dist < tol)

    # ------------------------------------------------------------------------
    # Tracing functions
    # ------------------------------------------------------------------------

    def interpolate_vector(point, points, vectors, neighbors, ref_dir):
        """
        Distance-weighted interpolation of neighbor vectors in 3D,
        flipping each neighbor's vector if dot < 0 with respect to 'ref_dir'.

        - pt: [x, y, z], the point where we want the interpolated vector
        - points_3d: Nx3 array of point coords
        - vectors_3d: Nx3 array of principal vectors
        - neighbors: list of indices from the KDTree
        - ref_dir: [dx, dy, dz], the direction from the previous step (or None if first step)
        """
        weights = []
        weighted_vec = [0.0, 0.0, 0.0]

        for i in neighbors:
            vx, vy, vz = vectors[i]  # copy so we can flip locally
            if ref_dir is not None:
                dotp = vx*ref_dir[0] + vy*ref_dir[1] + vz*ref_dir[2]
                if dotp < 0:
                    vx, vy, vz = -vx, -vy, -vz
            
            npt = points[i]
            dx = point[0] - npt[0]
            dy = point[1] - npt[1]
            dz = point[2] - npt[2]
            dist = (dx*dx + dy*dy + dz*dz)**0.5
            
            w = 1.0 / (dist + 1e-6)
            weights.append(w)
            
            weighted_vec[0] += vx*w
            weighted_vec[1] += vy*w
            weighted_vec[2] += vz*w

        total_w = sum(weights)
        if total_w > 1e-12:
            weighted_vec[0] /= total_w
            weighted_vec[1] /= total_w
            weighted_vec[2] /= total_w

        mag = (weighted_vec[0]**2 + weighted_vec[1]**2 + weighted_vec[2]**2)**0.5
        if mag < 1e-12:
            return [0.0, 0.0, 0.0]
        
        return [weighted_vec[0]/mag, weighted_vec[1]/mag, weighted_vec[2]/mag]

    def runge_kutta_step_3d(
        current_point, 
        current_dir,
        h, 
        k, 
        principal_vectors, 
        points_3d, 
        step_sign, 
        kd_tree, 
        boundary_curves=None, 
        boundary_tolerance=5, prev_dir=None):
        """
        Perform one RK4 step in 3D. Stop if next point is within 'boundary_tolerance'
        of any boundary curve (edges).
        Returns the next 3D point or None if out-of-bound / near boundary.
        """
        
        # 1) Neighbors & dynamic step size
        neighbors = find_closest_neighbors_kd(current_point, kd_tree, k)
        h = h * step_sign#adjust_step_size_3d(current_point, neighbors, points_3d, step_sign)
        
        # k1
        k1_dir = interpolate_vector(current_point, points_3d, principal_vectors, neighbors, current_dir)
        mid1 = [
            current_point[0] + 0.5*h*k1_dir[0],
            current_point[1] + 0.5*h*k1_dir[1],
            current_point[2] + 0.5*h*k1_dir[2]
        ]
        
        # k2
        neigh_mid1 = find_closest_neighbors_kd(mid1, kd_tree, k)
        k2_dir = interpolate_vector(mid1, points_3d, principal_vectors, neigh_mid1, k1_dir)
        mid2 = [
            current_point[0] + 0.5*h*k2_dir[0],
            current_point[1] + 0.5*h*k2_dir[1],
            current_point[2] + 0.5*h*k2_dir[2]
        ]
        
        # k3
        neigh_mid2 = find_closest_neighbors_kd(mid2, kd_tree, k)
        k3_dir = interpolate_vector(mid2, points_3d, principal_vectors, neigh_mid2, k2_dir)
        end_pt = [
            current_point[0] + h*k3_dir[0],
            current_point[1] + h*k3_dir[1],
            current_point[2] + h*k3_dir[2]
        ]
        
        # k4
        neigh_end = find_closest_neighbors_kd(end_pt, kd_tree, k)
        k4_dir = interpolate_vector(end_pt, points_3d, principal_vectors, neigh_end, k3_dir)
        
        # Summation
        dx = h*(k1_dir[0] + 2*k2_dir[0] + 2*k3_dir[0] + k4_dir[0]) / 6.0
        dy = h*(k1_dir[1] + 2*k2_dir[1] + 2*k3_dir[1] + k4_dir[1]) / 6.0
        dz = h*(k1_dir[2] + 2*k2_dir[2] + 2*k3_dir[2] + k4_dir[2]) / 6.0
        
        next_point = [
            current_point[0] + dx,
            current_point[1] + dy,
            current_point[2] + dz
        ]
        next_dir = k4_dir

        if domain_surface is not None:
            projected = project_onto_surface(domain_surface, next_point)
            print(projected)
            if projected is None:
                # Means we're off domain or near an open edge you consider invalid
                return None
            next_point = projected  # accept the projected coordinate



        # Otherwise return the next valid point
        return next_point, next_dir

    # ------------------------------------------------------------------------
    # Collision checks
    # ------------------------------------------------------------------------

    def closest_point_on_polyline_3d(pt3d, poly_curve):
        """
        Return (closest_point, distance) from a 3D point to a polyline curve.
        """
        test_pt = rg.Point3d(pt3d[0], pt3d[1], pt3d[2])
        rc, t = poly_curve.ClosestPoint(test_pt)
        if rc:
            cp = poly_curve.PointAt(t)
            dist = cp.DistanceTo(test_pt)
            return [cp.X, cp.Y, cp.Z], dist
        else:
            return None, float('inf')

    def find_closest_existing_line_3d(next_point, existing_trajectories, threshold):
        """
        Among all previously traced lines (in 3D), find if 'next_point' is within 'threshold' of any line.
        Returns (closest_line_index, closest_point_on_line, distance).
        """
        min_dist = float('inf')
        closest_line_idx = None
        closest_pt = None
        
        for i, (polyline_pts, poly_curve) in enumerate(existing_trajectories):
            cp, dist = closest_point_on_polyline_3d(next_point, poly_curve)
            if dist < min_dist:
                min_dist = dist
                closest_line_idx = i
                closest_pt = cp
        
        if min_dist < threshold:
            return (closest_line_idx, closest_pt, min_dist)
        else:
            return (None, None, float('inf'))

    def find_most_parallel_boundary_point(
        current_pt,
        last_step_vec,
        boundary_points,
        k=10):
        """
        Given a KD-tree of boundary sample points (boundary_kdtree)
        and the original array (boundary_points),
        find the boundary sample whose direction from current_pt 
        is most opposite (or "most parallel" – depends on how you measure) 
        to last_step_vec. Return (best_point, min_dist).

        boundary_points should be a Nx3 np.array or a list of [x,y,z].
        """
        
        if boundary_kdtree is None:
            return None, float('inf')
        
        cur_np = np.array(current_pt, dtype=float)
        step_np = np.array(last_step_vec, dtype=float)
        
        # if zero length, can't define direction
        step_len = np.linalg.norm(step_np)
        if step_len < 1e-12:
            return None, float('inf')
        step_np /= step_len
        
        # 1) Quickly find the 'k' closest boundary samples to current_pt
        #    using the KD-tree:
        #    If k=1, you'll get a single distance & index as floats
        #    If k>1, arrays
        distances, indices = boundary_kdtree.query(cur_np, k=k)

        # If k=1, make them arrays for consistency
        if k == 1:
            distances = [distances]
            indices = [indices]

        # 2) Among these k points, pick the direction which has 
        #    the smallest dot or largest negative dot, etc.
        best_dot = 9999
        best_pt = None
        min_dist = float('inf')

        # boundary_points is Nx3

        for dist, idx in zip(distances, indices):
            cand_np = boundary_points_array[idx]  # shape (3,)
            dir_vec = cand_np - cur_np
            dir_len = np.linalg.norm(dir_vec)
            if dir_len < 1e-12:
                continue
            dir_unit = dir_vec / dir_len
            dot_val = np.dot(dir_unit, step_np)
            
            # Suppose you want the direction that is "most parallel but reversed"
            # => you'd pick the smallest dot_val. If you want "most parallel, same direction,"
            # => you'd pick largest dot_val. 
            if dot_val < best_dot:
                best_dot = dot_val
                best_pt = cand_np
                # optional: track the boundary distance as well
                if dist < min_dist:
                    min_dist = dist

        # Convert best_pt to Rhino point
        if best_pt is not None:
            return rg.Point3d(best_pt[0], best_pt[1], best_pt[2]), min_dist
        else:
            return None, float('inf')


    # ------------------------------------------------------------------------
    # Sampling and offset functions
    # ------------------------------------------------------------------------

    def surface_normal_at_point(surface, pt3d, tolerance=2):
        """
        Returns the surface normal [nx, ny, nz] at a 3D point on a multi-face Brep or rg.Surface.
        If near an open edge or invalid, returns None.
        """
        pt_rh = rg.Point3d(pt3d[0], pt3d[1], pt3d[2])

        if isinstance(surface, rg.Brep):
            stuff = surface.ClosestPoint(pt_rh, tolerance)
            if not stuff or len(stuff) < 6:
                return None
            b = stuff[0]
            rc = stuff[1]
            print(rc)
            comp_index = stuff[2]
            u = stuff[3]
            v = stuff[4]
            # stuff[4] => cpt
            # stuff[5] => guess_normal
            if not rc:
                return None
            
            # If it's a face, we evaluate the face normal at (u, v)
            if comp_index.ComponentIndexType == rg.ComponentIndexType.BrepFace:
                face_id = comp_index.Index
                face = surface.Faces[face_id]
                exact_normal = face.NormalAt(u, v)
                if exact_normal:
                    return [exact_normal.X, exact_normal.Y, exact_normal.Z]
                else:
                    return None
            else:
                # edge/vertex
                return None
        
        elif isinstance(surface, rg.Surface):
            rc, u, v = surface.ClosestPoint(pt_rh)
            if rc:
                exact_normal = surface.NormalAt(u, v)
                return [exact_normal.X, exact_normal.Y, exact_normal.Z]
            else:
                return None

        # Not a Brep or Surface
        return None

    def offset_seed(psl_pts_3d, index, offset_distance, surface):
        """
        Offsets the PSL at psl_pts_3d[index] in the local tangent plane of 'surface'.
        Steps:
        1) Compute PSL tangent at index
        2) Get surface normal at that point
        3) binormal = cross(surface_normal, psl_tangent)
        4) candidate1 = point + offset_distance*binormal
            candidate2 = point - offset_distance*binormal
        5) (optional) project candidates back onto the surface
        Returns: (candidate1, candidate2) as [x, y, z], or (None, None) on error.
        """
        n = len(psl_pts_3d)
        if n < 2:
            return None, None
        
        # 0) Current point
        px, py, pz = psl_pts_3d[index]
        
        # 1) PSL TANGENT
        if index == 0:
            # Use next point - current point
            nx, ny, nz = psl_pts_3d[1]
            tx = nx - px
            ty = ny - py
            tz = nz - pz
        elif index == n - 1:
            # Use current point - prev point
            px_prev, py_prev, pz_prev = psl_pts_3d[n - 2]
            tx = px - px_prev
            ty = py - py_prev
            tz = pz - pz_prev
        else:
            # Middle: use psl_pts_3d[index+1] - psl_pts_3d[index-1]
            px_prev, py_prev, pz_prev = psl_pts_3d[index - 1]
            px_next, py_next, pz_next = psl_pts_3d[index + 1]
            tx = px_next - px_prev
            ty = py_next - py_prev
            tz = pz_next - pz_prev

        # Normalize tangent
        t_len = math.sqrt(tx*tx + ty*ty + tz*tz)
        if t_len < 1e-12:
            return None, None
        tx /= t_len
        ty /= t_len
        tz /= t_len
        
        # 2) SURFACE NORMAL
        normal = surface_normal_at_point(surface, [px, py, pz])
        if not normal:
            print("no normal")
            return None, None
        nx, ny, nz = normal
        n_len = math.sqrt(nx*nx + ny*ny + nz*nz)
        if n_len < 1e-12:
            return None, None
        nx /= n_len
        ny /= n_len
        nz /= n_len
        
        # 3) BINORMAL = cross(normal, tangent)
        # This is guaranteed to be in the tangent plane if PSL is truly tangent to the surface
        # If the PSL isn't exactly tangent, you'll get some tilt. 
        bx = ny*tz - nz*ty
        by = nz*tx - nx*tz
        bz = nx*ty - ny*tx
        b_len = math.sqrt(bx*bx + by*by + bz*bz)
        if b_len < 1e-12:
            # Means normal and tangent are parallel or something degenerate
            return None, None
        bx /= b_len
        by /= b_len
        bz /= b_len
        
        # 4) OFFSET POINTS
        candidate1 = [px + offset_distance*bx,
                    py + offset_distance*by,
                    pz + offset_distance*bz]
        candidate2 = [px - offset_distance*bx,
                    py - offset_distance*by,
                    pz - offset_distance*bz]
        
        # 5) (OPTIONAL) Project them onto the surface if you want them exactly on the domain
        candidate1_proj = project_onto_surface(surface, candidate1)
        print(f"this point is seed {candidate1_proj}")
        candidate2_proj = project_onto_surface(surface, candidate2)
        # if not candidate1_proj or not candidate2_proj:
        #     return None, None
        # return candidate1_proj, candidate2_proj

        # If you don't need the final projection, just return them:
        return candidate1_proj, candidate2_proj

    def sample_psl_3d(psl_pts):
        """
        Given a PSL (list of Rhino Point3d or numeric [x,y,z] points),
        sample it every 'sample_interval' points.
        Returns a list of tuples: ( [x,y,z], original_index )
        """
        samples = []
        for i in range(0, len(psl_pts), sample_interval):
            pt3d = psl_pts[i]
            # Convert to numeric [x,y,z] if it's a Point3d
            if hasattr(pt3d, "X"):
                samples.append(([pt3d.X, pt3d.Y, pt3d.Z], i))
            else:
                samples.append((pt3d, i))
        return samples

    def is_valid_seed(candidate, existing_trajectories, min_distance, boundary_curves):
        """
        Check if candidate seed is valid:
        - It is not too close to any existing PSL (using min_distance).
        - It is not too close to any boundary curves (if boundary_curves is provided and
            candidate's distance < boundary_tolerance).
        """
        # Check candidate against existing PSLs
        idx, cp, dist = find_closest_existing_line_3d(candidate, existing_trajectories, min_distance)
        if idx is not None:
            return False

        # Check candidate against boundary curves if provided
        if boundary_curves:
            dist_edge, cp_edge = distance_to_brep_edges(candidate, boundary_curves)
            if dist_edge < seed_boundary_dist:
                return False

        return True


    # ------------------------------------------------------------------------
    # Tracing logic
    # ------------------------------------------------------------------------

    def trace_psl_both_directions(
        seed_point_3d, 
        h, 
        num_steps, 
        k, 
        principal_vectors, 
        points_3d,
        boundary_curves=None,
        boundary_tolerance=boundary_tolerance,
        existing_trajectories=None,
        collision_threshold=collision_threshold,
        closing_threshold=closing_threshold, 
        kd_tree=None,
        existing_merge_pts = None):
        """
        Single-loop approach where forward/backward can stop independently.
        If forward hits a collision/boundary, it stops, but backward can continue, and vice versa.
        We only stop the entire PSL when BOTH directions are inactive, or when tips meet.
        """
        if existing_trajectories is None:
            existing_trajectories = []
        
        import Rhino.Geometry as rg
        bridging_lines = []
        merge_points = []

        # We'll keep two lines: forward and backward
        forward_line = [rg.Point3d(*seed_point_3d)]
        backward_line = [rg.Point3d(*seed_point_3d)]
        
        # Current forward/backward points + directions
        f_current_pt = list(seed_point_3d)
        f_current_dir = None
        b_current_pt = list(seed_point_3d)
        b_current_dir = None

        # NEW: Boolean flags to track if forward/backward are still active
        forward_active = True
        backward_active = True

        for step_i in range(num_steps):
            
            # ---------------------------
            # FORWARD STEP (if still active)
            # ---------------------------
            if forward_active:
                f_next = runge_kutta_step_3d(
                    f_current_pt,
                    f_current_dir,
                    h,
                    k,
                    principal_vectors,
                    points_3d,
                    step_sign=+1,
                    kd_tree=kd_tree,
                    boundary_curves=boundary_curves,
                    boundary_tolerance=boundary_tolerance
                )
                if not f_next or f_next[0] is None:
                    print(f"PSL forward direction stopped at iteration {step_i}.")
                    forward_active = False
                else:
                    f_next_pt, f_next_dir = f_next
                    # Collision check with existing PSLs
                    if existing_trajectories:
                        line_idx, close_pt, dist_cl = find_closest_existing_line_3d(
                            f_next_pt, existing_trajectories, collision_threshold
                        )

                        if len(existing_merge_pts) > 1 and close_pt is not None:
                            print(f"merged = {merge_points}")
                            close_pt = is_point_close_to_any(existing_merge_pts, close_pt, snap_radius)

                        if line_idx is not None and close_pt is not None:
                            # Instead of break, we do bridging & disable forward
                            
                            if len(forward_line) > n_back:
                                bridging_line = rg.Line(
                                    forward_line[-n_back],
                                    rg.Point3d(*close_pt)
                                )
                                bridging_lines.append(bridging_line)
                                merge_points.append(rg.Point3d(*close_pt))
                                del forward_line[-(n_back-1):]

                            if len(forward_line)==0 or len(backward_line)==1:
                                print("too short for bridge")
                            else:
                                bridging_line = rg.Line(
                                    forward_line[-1],
                                    rg.Point3d(*close_pt)
                                )
                                bridging_lines.append(bridging_line)
                                merge_points.append(rg.Point3d(*close_pt))
                            
                            print(f"PSL forward collided with line {line_idx} at dist {dist_cl:.3f}.")
                            forward_active = False

                        # 2) Check distance to boundary edges, if we have them
                    if boundary_curves:
                        dir_vec = [-1*x for x in f_next_dir]
                        cp,dist_to_edge = find_most_parallel_boundary_point(f_next_pt,dir_vec,boundary_curves,k_edge)
                        if dist_to_edge < boundary_tolerance:
                            # We consider that "off" or "too close" => stop
                            print(f"PSL forward reached boundary.")
                            forward_active = False
                            bridging_line = rg.Line(
                                    forward_line[-1],
                                    rg.Point3d(cp)
                            )
                            bridging_lines.append(bridging_line)


                    # If still active, accept the new forward step
                    if forward_active:
                        forward_line.append(rg.Point3d(*f_next_pt))
                        f_current_pt = f_next_pt
                        f_current_dir = f_next_dir

            # ---------------------------
            # BACKWARD STEP (if still active)
            # ---------------------------
            if backward_active:
                b_next = runge_kutta_step_3d(
                    b_current_pt,
                    b_current_dir,
                    h,
                    k,
                    principal_vectors,
                    points_3d,
                    step_sign=-1,
                    kd_tree=kd_tree,
                    boundary_curves=boundary_curves,
                    boundary_tolerance=boundary_tolerance
                )
                if not b_next or b_next[0] is None:
                    print(f"PSL backward direction stopped at iteration {step_i}.")
                    backward_active = False
                else:
                    b_next_pt, b_next_dir = b_next
                    # Collision check with existing PSLs
                    if existing_trajectories:
                        line_idx, close_pt, dist_cl = find_closest_existing_line_3d(
                            b_next_pt, existing_trajectories, collision_threshold
                        )


                        if len(existing_merge_pts) > 1 and close_pt is not None:
                            print(f"merged = {merge_points}")
                            close_pt = is_point_close_to_any(existing_merge_pts, close_pt, snap_radius)

                        if line_idx is not None and close_pt is not None:
                            
                            if len(backward_line) > n_back:
                                bridging_line = rg.Line(
                                    backward_line[-n_back],
                                    rg.Point3d(*close_pt)
                                )
                                bridging_lines.append(bridging_line)
                                merge_points.append(rg.Point3d(*close_pt))
                                del backward_line[-(n_back-1):]

                            if len(backward_line)==0 or len(backward_line)==1:
                                print("too short for bridge")
                            else:
                                bridging_line = rg.Line(
                                    backward_line[-1],
                                    rg.Point3d(*close_pt)
                                )
                                bridging_lines.append(bridging_line)
                                merge_points.append(rg.Point3d(*close_pt))

                            print(f"PSL backward collided with line {line_idx} at dist {dist_cl:.3f}.")
                            backward_active = False


                    if boundary_curves:
                        
                        cp,dist_to_edge = find_most_parallel_boundary_point(b_next_pt,b_next_dir,boundary_curves,k_edge)
                        if dist_to_edge < boundary_tolerance:
                            # We consider that "off" or "too close" => stop
                            print(f"PSL forward reached boundary.")
                            backward_active = False
                            bridging_line = rg.Line(
                                    backward_line[-1],
                                    rg.Point3d(cp)
                            )
                            bridging_lines.append(bridging_line)

                    # If still active, accept the new backward step
                    if backward_active:
                        backward_line.append(rg.Point3d(*b_next_pt))
                        b_current_pt = b_next_pt
                        b_current_dir = b_next_dir
            
            # ---------------------------
            # Check if BOTH directions are done
            # ---------------------------
            if not forward_active and not backward_active:
                print("Both forward & backward directions inactive => stopping PSL.")
                break

            # ---------------------------
            # TIP DISTANCE CHECK
            # ---------------------------
            # Only if both are still active
            if forward_active and backward_active and step_i >= 10:
                f_xyz = [forward_line[-1].X, forward_line[-1].Y, forward_line[-1].Z]
                b_xyz = [backward_line[-1].X, backward_line[-1].Y, backward_line[-1].Z]
                dist_fb = distance_3d(f_xyz, b_xyz)
                if dist_fb < closing_threshold:
                    bridging_line = rg.Line(
                        forward_line[-1],
                        backward_line[-1]
                    )
                    bridging_lines.append(bridging_line)

                    print(
                        f"PSL tips meet at iteration {step_i}, dist= {dist_fb:.3f} < {closing_threshold}."
                    )
                    # Here we might disable both directions or just break:
                    forward_active = False
                    backward_active = False
                    break
        
        # Merge lines
        backward_line.reverse()
        if len(backward_line) > 1:
            backward_line.pop()
        merged_pts = backward_line + forward_line
        
        return merged_pts, bridging_lines,merge_points

    def generate_all_psls_3d(
        initial_seed_3d,
        h, 
        num_steps, 
        k, 
        principal_vectors, 
        points_3d,
        kd_tree,
        boundary_curves,
        collision_threshold,
        sample_interval,
        offset_distance,
        min_seed_distance):
        """

        Generate PSLs using an iterative seeding strategy (3D version).

        1) Trace the initial PSL from initial_seed_3d.
        2) Put that PSL in a queue.
        3) For each PSL in the queue, sample it, offset each sample to find new seeds.
        4) If a new seed is valid, trace a new PSL & add it to the queue.
        
        Returns:
        - all_psls: list of (psl_points, polyline_curve)
        - bridging_lines: short lines merging PSLs
        - positive_candidates: list of seeds that were actually used
        """
        existing_merge_pts = []

        initial_psl, initial_bridges, merge_points = trace_psl_both_directions(
            seed_point_3d=initial_seed_3d,
            h=h,
            num_steps=num_steps,
            k=k,
            principal_vectors=principal_vectors,
            points_3d=points_3d,
            boundary_curves=boundary_curves,
            boundary_tolerance=boundary_tolerance,
            existing_trajectories=None,
            collision_threshold=collision_threshold,
            closing_threshold=closing_threshold,  # or some distance
            kd_tree=kd_tree,
            existing_merge_pts = existing_merge_pts
        )


        # Build polyline curve (3D) for collision checking
        initial_curve = build_polyline_curve_3d(initial_psl)
        all_psls = [(initial_psl, initial_curve)]
        bridging_lines = []
        positive_candidates = []
        if initial_bridges:
            bridging_lines.extend(initial_bridges)
        
        # 2) PSL queue
        psl_queue = [(initial_psl, initial_curve)]

        
        # 3) BFS-like expansion
        while psl_queue:
            
            current_psl, current_curve = psl_queue.pop(0)
            # numeric version
            psl_numeric_3d = [[pt.X, pt.Y, pt.Z] for pt in current_psl]
            
            # Sample
            samples = sample_psl_3d(current_psl)  # returns ( [x,y,z], index )
            
            # For each sample, offset in 3D
            for sample_pt_3d, orig_index in samples:
                cand1, cand2 = offset_seed(psl_numeric_3d, orig_index, offset_distance, domain_surface)
                if not cand1 or not cand2:
                    continue  # offset failed or degenerate tangent
                
                # We'll try both
                candidates_3d = [cand1, cand2]
                
                traced_this_sample = False
                for candidate_3d in candidates_3d:
                    # Check if candidate is valid:
                    #   1) at least min_seed_distance from existing PSL
                    if not is_valid_seed(candidate_3d, all_psls, min_seed_distance,boundary_curves):
                        continue
                    # #   2) on or within boundary surface (if you want)
                    # if not rs.IsPointOnSurface(domain_surface, candidate_3d):
                    #     continue
                    
                    # We have a new seed
                    print("Candidate seed found:", candidate_3d)
                    positive_candidates.append(candidate_3d)
                    
                    # Trace a new PSL
                    new_psl, new_bridges, merge_points = trace_psl_both_directions(
                        seed_point_3d=candidate_3d,
                        h=h,
                        num_steps=num_steps,
                        k=k,
                        principal_vectors=principal_vectors,
                        points_3d=points_3d,
                        boundary_curves=boundary_curves,
                        boundary_tolerance=boundary_tolerance,
                        existing_trajectories=all_psls,
                        collision_threshold=collision_threshold,
                        closing_threshold=closing_threshold,  # or some distance
                        kd_tree=kd_tree,
                        existing_merge_pts = existing_merge_pts

                    )
                    new_curve = build_polyline_curve_3d(new_psl)
                    
                    # Add to collection
                    all_psls.append((new_psl, new_curve))
                    psl_queue.append((new_psl, new_curve))
                    existing_merge_pts.append(merge_points)
                    print(f"checkkkkkk = {existing_merge_pts}")
                    if new_bridges:
                        bridging_lines.extend(new_bridges)
                    
                    traced_this_sample = True
                    # If you only want one PSL from this sample, break here
                    break
        
        return all_psls, bridging_lines, positive_candidates




    # ------------------------------------------------------------------------
    # Build KD Trees
    # ------------------------------------------------------------------------

    #1) mesh points kdtree
    points_array_3d = [to_xyz(pt) for pt in points]
    points_np = np.array(points_array_3d)  # shape (N, 3)
    kd_tree = KDTree(points_np)

    initial_seed_3d = to_xyz(seed_point)
    principal_vectors_3d = [to_xyz(vec) for vec in principal_vectors]


    #2) boundary sample points kdtree
    sampled_boundary_pts = []
    for crv in boundary_curves:
        params = crv.DivideByCount(sample_count, True)
        for t in params:
            p = crv.PointAt(t)
            sampled_boundary_pts.append([p.X, p.Y, p.Z])

    if sampled_boundary_pts:
        boundary_points_array = np.array(sampled_boundary_pts, dtype=float)
        boundary_kdtree = KDTree(boundary_points_array)
    else:
        boundary_kdtree = None




    # ----------------------------------------------------------------------
    # CALL YOUR 3D PSL GENERATION FUNCTION
    # ----------------------------------------------------------------------
    all_psls, bridging_lines, positive_candidates = generate_all_psls_3d(
        initial_seed_3d,
        h,
        num_steps,
        k,
        principal_vectors_3d,   # 3D vectors
        points_array_3d,        # 3D points
        kd_tree,
        boundary_curves,
        collision_threshold,
        sample_interval,
        offset_distance,
        min_seed_distance
    )



    # ----------------------------------------------------------------------
    # PREPARE OUTPUTS FOR GH
    # ----------------------------------------------------------------------
    # 1) PSL polylines as GH curves
    psl_curves = [psl_curve for (psl_points, psl_curve) in all_psls]
    generated_seed_points = [rg.Point3d(pc[0], pc[1], pc[2]) for pc in positive_candidates]

    # 4) Finally set GH outputs (A, B, C, e.g.)
    psl = tr.list_to_tree(psl_curves)
    connect = tr.list_to_tree(bridging_lines)
    valid_seeds = tr.list_to_tree(generated_seed_points)

    return psl, connect, valid_seeds








#BASIC
h = 0.4                         #Step length
num_steps = 1000                #Max iterations
k = 15                          #Interpolation amount
collision_threshold = 1.5       #Distance constraint
snap_radius = 1                 #Snapping radius
n_back = 5                      #Steps back when merging
offset_distance = 3             #Offset distance
sample_interval = 2             #Sampling for offsets

sample_count = 300              #Sampling boundaries for edge connection 
k_edge = 30                     #Edge connection considerations
ratio_minseed_coll = 1.5        #Ratio between min_seed_distance and collision_threshold   min_seed_distance = collision_threshold * ratio









psl, connect, valid_seeds = main(h,num_steps,k,collision_threshold,snap_radius,n_back,offset_distance,sample_interval,sample_count,k_edge,ratio_minseed_coll,seed_point,principal_vectors,points,domain_surface,boundary_curves)
# ---------- end tracer_automatic_3d_self_single_loop ----------
cull_i_4 = CullIndex(List=divlength_2.Points, Indices=[0, -1], Wrap=True)
pt_2 = Point(flatten(cull_2))
seq = Sequence(Notation="[N-1] + 1", Length=lng, Initial=0)
explode_4 = Explode(Curve=crv_8, Recursive=True)  # -> Segments, Vertices
tracer_manual_3d_self = Python3Script(
    aa=flatten(cull_i),
    bb=shellvecresults.SecondPrincipalStressVector_kN_cm²,
    cc=shellvecresults.Points,
    dd=msh2psrf,
    ee=explode_3.Segments)  # -> out, a, b, Error_message, c; inputs aa: list of Point3d, bb: list of Vector3d, cc: list of Point3d, dd: Brep, ee: list of Curve
# ---------- tracer_manual_3d_self: Python ----------
def main(h,num_steps,k,collision_threshold,merge_radius,n_back,sample_count,k_edge,seed_points,principal_vectors,points,domain_surface,boundary_curves):


    import math
    import rhinoscriptsyntax as rs
    import Rhino
    import Rhino.Geometry as rg
    import scriptcontext as sc
    import numpy as np
    from scipy.spatial import KDTree
    from ghpythonlib import treehelpers as tr
    import cProfile, pstats, io


    # ------------------------------------------------------------------------
    # Variables
    # ------------------------------------------------------------------------





    #set values
    tolerance_proj = 2000        #Max distance for projection
    boundary_tolerance= h
    closing_threshold=h


    # ------------------------------------------------------------------------
    # 3D UTILITY FUNCTIONS
    # ------------------------------------------------------------------------





    def distance_3d(a, b):
        return math.sqrt((a[0]-b[0])**2 + (a[1]-b[1])**2 + (a[2]-b[2])**2)

    def to_xyz(pt_or_vec):
        """Converts Rhino.Geometry.Point3d or Vector3d (or numeric [x,y,z]) to a Python list [x, y, z]."""
        if hasattr(pt_or_vec, "X"):
            return [pt_or_vec.X, pt_or_vec.Y, pt_or_vec.Z]
        else:
            return [pt_or_vec[0], pt_or_vec[1], pt_or_vec[2]]

    def normalize_3d(vec):
        """Normalize a 3D vector [x, y, z] to unit length. Returns [0,0,0] if near zero length."""
        mag = math.sqrt(vec[0]**2 + vec[1]**2 + vec[2]**2)
        if mag < 1e-12:
            return [0.0, 0.0, 0.0]
        return [vec[0]/mag, vec[1]/mag, vec[2]/mag]

    def find_closest_neighbors_kd_3d(point, kd_tree, k):
        """
        Given a 3D point [x, y, z] and a KDTree, returns a list of indices of the k closest points.
        """
        distances, indices = kd_tree.query(point, k=k)
        if isinstance(indices, int):
            return [indices]
        return list(indices)



    # ------------------------------------------------------------------------
    # TRACING FUNCTIONS
    # ------------------------------------------------------------------------


    def interpolate_vector_3d_consistent(pt, points_3d, vectors_3d, neighbors, ref_dir):
        """
        Distance-weighted interpolation of neighbor vectors in 3D,
        flipping each neighbor's vector if dot < 0 with respect to 'ref_dir'.

        - pt: [x, y, z], the point where we want the interpolated vector
        - points_3d: Nx3 array of point coords
        - vectors_3d: Nx3 array of principal vectors
        - neighbors: list of indices from the KDTree
        - ref_dir: [dx, dy, dz], the direction from the previous step (or None if first step)
        """
        weights = []
        weighted_vec = [0.0, 0.0, 0.0]

        for i in neighbors:
            vx, vy, vz = vectors_3d[i]  # copy so we can flip locally
            if ref_dir is not None:
                dotp = vx*ref_dir[0] + vy*ref_dir[1] + vz*ref_dir[2]
                if dotp < 0:
                    vx, vy, vz = -vx, -vy, -vz
            
            npt = points_3d[i]
            dx = pt[0] - npt[0]
            dy = pt[1] - npt[1]
            dz = pt[2] - npt[2]
            dist = (dx*dx + dy*dy + dz*dz)**0.5
            
            w = 1.0 / (dist + 1e-6)
            weights.append(w)
            
            weighted_vec[0] += vx*w
            weighted_vec[1] += vy*w
            weighted_vec[2] += vz*w

        total_w = sum(weights)
        if total_w > 1e-12:
            weighted_vec[0] /= total_w
            weighted_vec[1] /= total_w
            weighted_vec[2] /= total_w

        mag = (weighted_vec[0]**2 + weighted_vec[1]**2 + weighted_vec[2]**2)**0.5
        if mag < 1e-12:
            return [0.0, 0.0, 0.0]
        
        return [weighted_vec[0]/mag, weighted_vec[1]/mag, weighted_vec[2]/mag]

    def runge_kutta_step_3d(
        current_point, 
        current_dir,
        h, 
        k, 
        principal_vectors, 
        points_3d, 
        step_sign, 
        kd_tree, 
        boundary_curves=None, 
        boundary_tolerance=boundary_tolerance,prev_dir=None):
        """
        Perform one RK4 step in 3D. Stop if next point is within 'boundary_tolerance'
        of any boundary curve (edges).
        Returns the next 3D point or None if out-of-bound / near boundary.
        """
        
        # 1) Neighbors & dynamic step size
        neighbors = find_closest_neighbors_kd_3d(current_point, kd_tree, k)
        h = h * step_sign#adjust_step_size_3d(current_point, neighbors, points_3d, step_sign)
        
        # k1
        k1_dir = interpolate_vector_3d_consistent(current_point, points_3d, principal_vectors, neighbors, current_dir)
        mid1 = [
            current_point[0] + 0.5*h*k1_dir[0],
            current_point[1] + 0.5*h*k1_dir[1],
            current_point[2] + 0.5*h*k1_dir[2]
        ]
        
        # k2
        neigh_mid1 = find_closest_neighbors_kd_3d(mid1, kd_tree, k)
        k2_dir = interpolate_vector_3d_consistent(mid1, points_3d, principal_vectors, neigh_mid1, k1_dir)
        mid2 = [
            current_point[0] + 0.5*h*k2_dir[0],
            current_point[1] + 0.5*h*k2_dir[1],
            current_point[2] + 0.5*h*k2_dir[2]
        ]
        
        # k3
        neigh_mid2 = find_closest_neighbors_kd_3d(mid2, kd_tree, k)
        k3_dir = interpolate_vector_3d_consistent(mid2, points_3d, principal_vectors, neigh_mid2, k2_dir)
        end_pt = [
            current_point[0] + h*k3_dir[0],
            current_point[1] + h*k3_dir[1],
            current_point[2] + h*k3_dir[2]
        ]
        
        # k4
        neigh_end = find_closest_neighbors_kd_3d(end_pt, kd_tree, k)
        k4_dir = interpolate_vector_3d_consistent(end_pt, points_3d, principal_vectors, neigh_end, k3_dir)
        
        # Summation
        dx = h*(k1_dir[0] + 2*k2_dir[0] + 2*k3_dir[0] + k4_dir[0]) / 6.0
        dy = h*(k1_dir[1] + 2*k2_dir[1] + 2*k3_dir[1] + k4_dir[1]) / 6.0
        dz = h*(k1_dir[2] + 2*k2_dir[2] + 2*k3_dir[2] + k4_dir[2]) / 6.0
        
        next_point = [
            current_point[0] + dx,
            current_point[1] + dy,
            current_point[2] + dz
        ]
        next_dir = k4_dir

        if domain_surface is not None:
            projected = project_onto_surface(domain_surface, next_point, tolerance_proj)
            #print(projected)
            if projected is None:
                # Means we're off domain or near an open edge you consider invalid
                return None
            next_point = projected  # accept the projected coordinate


        # Otherwise return the next valid point
        return next_point, next_dir


    # ------------------------------------------------------------------------#
    # SURFACE / BREP PROJECTION UTILS
    # ------------------------------------------------------------------------#

    def project_onto_surface(surface, pt3d, tolerance_proj):
        pt_rh = rg.Point3d(pt3d[0], pt3d[1], pt3d[2])
        
        if isinstance(surface, rg.Brep):
            # Note the 6 returned values:
            rc, closest_pt, cindex, u, v, normal = surface.ClosestPoint(pt_rh, tolerance_proj)
            if rc:
                # Check if cindex is a face
                if cindex.ComponentIndexType == rg.ComponentIndexType.BrepFace:
                    face_id = cindex.Index
                    face = surface.Faces[face_id]
                    
                    # 'closest_pt' is the 3D point on that face
                    # Optionally confirm it's within the face domain or do face.IsPointOnFace(u,v)
                    
                    return [closest_pt.X, closest_pt.Y, closest_pt.Z]
                else:
                    # The closest component might be an edge or vertex
                    return None
            else:
                return None
        
        elif isinstance(surface, rg.Surface):
            rc, u, v = surface.ClosestPoint(pt_rh)
            if rc:
                pt_srf = surface.PointAt(u, v)
                return [pt_srf.X, pt_srf.Y, pt_srf.Z]
            else:
                return None
        else:
            return None

    def is_on_surface(surface, pt3d, tol=0.01):
        """
        Returns True if pt3d is within 'tol' of the surface. 
        """
        if not surface: 
            return True  # no surface provided
        pproj = project_onto_surface(surface, pt3d)
        if pproj is None:
            return False
        dx = pt3d[0] - pproj[0]
        dy = pt3d[1] - pproj[1]
        dz = pt3d[2] - pproj[2]
        dist = math.sqrt(dx*dx + dy*dy + dz*dz)
        return (dist < tol)



    # ------------------------------------------------------------------------
    # COLLISION/DISTANCE CHECKS
    # ------------------------------------------------------------------------


    def build_polyline_curve_3d(poly_pts):
        pts3d = [rg.Point3d(pt[0], pt[1], pt[2]) for pt in poly_pts]
        poly = rg.Polyline(pts3d)
        return rg.PolylineCurve(poly)

    def closest_point_on_polyline_3d(pt3d, poly_curve):
        """
        Return (closest_point, distance) from a 3D point to a polyline curve.
        """
        test_pt = rg.Point3d(pt3d[0], pt3d[1], pt3d[2])
        rc, t = poly_curve.ClosestPoint(test_pt)
        if rc:
            cp = poly_curve.PointAt(t)
            dist = cp.DistanceTo(test_pt)
            return [cp.X, cp.Y, cp.Z], dist
        else:
            return None, float('inf')

    def find_closest_existing_line_3d(next_point, existing_trajectories, threshold):
        """
        Among all previously traced lines (in 3D), find if 'next_point' is within 'threshold' of any line.
        Returns (closest_line_index, closest_point_on_line, distance).
        """
        min_dist = float('inf')
        closest_line_idx = None
        closest_pt = None
        
        for i, (polyline_pts, poly_curve) in enumerate(existing_trajectories):
            cp, dist = closest_point_on_polyline_3d(next_point, poly_curve)
            if dist < min_dist:
                min_dist = dist
                closest_line_idx = i
                closest_pt = cp
        
        if min_dist < threshold:
            return (closest_line_idx, closest_pt, min_dist)
        else:
            return (None, None, float('inf'))

    def is_point_close_to_any(point_list, single_point, threshold):
        flat = [item for sublist in point_list for item in sublist]
        #print(f"single = {single_point}")
        single_point_1 = rg.Point3d(single_point[0],single_point[1],single_point[2])
        
        
        for pt in flat:
            #print(f"pt = {pt}")
            if single_point_1.DistanceTo(pt) <= threshold:
                return pt
        return single_point

    def find_most_parallel_boundary_point(
        current_pt,
        last_step_vec,
        boundary_points,
        k=10):
        """
        Given a KD-tree of boundary sample points (boundary_kdtree)
        and the original array (boundary_points),
        find the boundary sample whose direction from current_pt 
        is most opposite (or "most parallel" – depends on how you measure) 
        to last_step_vec. Return (best_point, min_dist).

        boundary_points should be a Nx3 np.array or a list of [x,y,z].
        """
        
        if boundary_kdtree is None:
            return None, float('inf')
        
        cur_np = np.array(current_pt, dtype=float)
        step_np = np.array(last_step_vec, dtype=float)
        
        # if zero length, can't define direction
        step_len = np.linalg.norm(step_np)
        if step_len < 1e-12:
            return None, float('inf')
        step_np /= step_len
        
        # 1) Quickly find the 'k' closest boundary samples to current_pt
        #    using the KD-tree:
        #    If k=1, you'll get a single distance & index as floats
        #    If k>1, arrays
        distances, indices = boundary_kdtree.query(cur_np, k=k)

        # If k=1, make them arrays for consistency
        if k == 1:
            distances = [distances]
            indices = [indices]

        # 2) Among these k points, pick the direction which has 
        #    the smallest dot or largest negative dot, etc.
        best_dot = 9999
        best_pt = None
        min_dist = float('inf')

        # boundary_points is Nx3

        for dist, idx in zip(distances, indices):
            cand_np = boundary_points_array[idx]  # shape (3,)
            dir_vec = cand_np - cur_np
            dir_len = np.linalg.norm(dir_vec)
            if dir_len < 1e-12:
                continue
            dir_unit = dir_vec / dir_len
            dot_val = np.dot(dir_unit, step_np)
            
            # Suppose you want the direction that is "most parallel but reversed"
            # => you'd pick the smallest dot_val. If you want "most parallel, same direction,"
            # => you'd pick largest dot_val. 
            if dot_val < best_dot:
                best_dot = dot_val
                best_pt = cand_np
                # optional: track the boundary distance as well
                if dist < min_dist:
                    min_dist = dist

        # Convert best_pt to Rhino point
        if best_pt is not None:
            return rg.Point3d(best_pt[0], best_pt[1], best_pt[2]), min_dist
        else:
            return None, float('inf')


    # ------------------------------------------------------------------------
    # TRACE PSL IN BOTH DIRECTIONS (3D)
    # ------------------------------------------------------------------------               


    def trace_psl_both_directions_in_one_loop_3d(
        seed_point_3d,
        h, 
        num_steps,
        k,
        principal_vectors, 
        points_3d,
        kd_tree,
        boundary_curves=None,
        boundary_tolerance=boundary_tolerance,
        existing_trajectories=None,
        collision_threshold=collision_threshold,
        closing_threshold=closing_threshold,
        existing_merge_pts = None):
        """
        Traces a PSL forward (+1) and backward (-1) in ONE loop, letting each direction
        stop or collide independently. If forward is done, backward can keep going (and vice versa).
        If both are done, or tips meet, we stop entirely.
        """
        if existing_trajectories is None:
            existing_trajectories = []
        
        import Rhino.Geometry as rg
        from math import sqrt

        # Initialize lines
        forward_line = [rg.Point3d(*seed_point_3d)]
        backward_line = [rg.Point3d(*seed_point_3d)]

        # Current states
        f_current_pt = list(seed_point_3d)
        f_current_dir = None
        b_current_pt = list(seed_point_3d)
        b_current_dir = None

        bridging_lines = []
        merge_points = []

        # NEW: Flags for forward/backward
        forward_active = True
        backward_active = True

        for step_i in range(num_steps):
            # --------------------------------------------------
            # FORWARD STEP (if still active)
            # --------------------------------------------------
            if forward_active:
                f_next = runge_kutta_step_3d(
                    f_current_pt,
                    f_current_dir,
                    h,
                    k,
                    principal_vectors,
                    points_3d,
                    step_sign=+1,
                    kd_tree=kd_tree,
                    boundary_curves=boundary_curves,
                    boundary_tolerance=boundary_tolerance
                )
                if not f_next or (f_next[0] is None):
                    print(f"PSL forward direction stopped at iteration {step_i}.")
                    # Do NOT break from the entire loop
                    forward_active = False
                else:
                    # Accept the new point
                    f_next_pt, f_next_dir = f_next
                    
                    # Optional collision check
                    if existing_trajectories:
                        line_idx, close_pt, dist_cl = find_closest_existing_line_3d(
                            f_next_pt, existing_trajectories, collision_threshold
                        )
                        if len(existing_merge_pts) > 1 and close_pt is not None:
                            
                            close_pt = is_point_close_to_any(existing_merge_pts, close_pt, merge_radius) #snapping

                        if line_idx is not None and close_pt is not None:
                            # Instead of break, we do bridging & disable forward
                            steps_back = n_back
                            if len(forward_line) > steps_back:
                                bridging_line = rg.Line(
                                    forward_line[-steps_back],
                                    rg.Point3d(*close_pt)
                                )
                                bridging_lines.append(bridging_line)
                                merge_points.append(rg.Point3d(*close_pt))
                                del forward_line[-(steps_back-1):]
                            if len(forward_line)==0:
                                print("too short for bridge")
                            else:
                                bridging_line = rg.Line(
                                    forward_line[-1],
                                    rg.Point3d(*close_pt)
                                )
                                bridging_lines.append(bridging_line)
                                merge_points.append(rg.Point3d(*close_pt))
                            
                            print(f"PSL forward collided with line {line_idx} at dist {dist_cl:.3f}.")
                            forward_active = False

                        # 2) Check distance to boundary edges, if we have them

                    if boundary_curves:
                        dir_vec = [-1*x for x in f_next_dir]
                        cp,dist_to_edge = find_most_parallel_boundary_point(f_next_pt,dir_vec,boundary_curves,k_edge)
                        if dist_to_edge < boundary_tolerance:
                            # We consider that "off" or "too close" => stop
                            print(f"PSL forward reached boundary.")
                            forward_active = False
                            bridging_line = rg.Line(
                                    forward_line[-1],
                                    rg.Point3d(cp)
                            )
                            bridging_lines.append(bridging_line)
                            
                    # If still active after collision checks, append the step
                    if forward_active:
                        forward_line.append(rg.Point3d(*f_next_pt))
                        f_current_pt = f_next_pt
                        f_current_dir = f_next_dir

            # --------------------------------------------------
            # BACKWARD STEP (if still active)
            # --------------------------------------------------
            if backward_active:
                b_next = runge_kutta_step_3d(
                    b_current_pt,
                    b_current_dir,
                    h,
                    k,
                    principal_vectors,
                    points_3d,
                    step_sign=-1,
                    kd_tree=kd_tree,
                    boundary_curves=boundary_curves,
                    boundary_tolerance=boundary_tolerance
                )
                if not b_next or (b_next[0] is None):
                    print(f"PSL backward direction stopped at iteration {step_i}.")
                    backward_active = False
                else:
                    b_next_pt, b_next_dir = b_next
                    
                    if existing_trajectories:
                        line_idx, close_pt, dist_cl = find_closest_existing_line_3d(
                            b_next_pt, existing_trajectories, collision_threshold
                        )
                        if len(existing_merge_pts) > 1 and close_pt is not None:
                            close_pt = is_point_close_to_any(existing_merge_pts, close_pt, merge_radius)

                        if line_idx is not None and close_pt is not None:
                            steps_back = n_back
                        
                            if len(backward_line) > steps_back:
                                bridging_line = rg.Line(
                                    backward_line[-steps_back],
                                    rg.Point3d(*close_pt)
                                )
                                del backward_line[-(steps_back-1):]
                                bridging_lines.append(bridging_line)
                                merge_points.append(rg.Point3d(*close_pt))

                            if len(backward_line)==0:
                                print("too short for bridge")
                            else:
                                bridging_line = rg.Line(
                                    backward_line[-1],
                                    rg.Point3d(*close_pt)
                                )
                                bridging_lines.append(bridging_line)
                                merge_points.append(rg.Point3d(*close_pt))
                            print(f"PSL backward collided with line {line_idx} at dist {dist_cl:.3f}.")
                            backward_active = False




                    #print(f"direction = {b_current_dir}")
                    if boundary_curves:
                        cp,dist_to_edge = find_most_parallel_boundary_point(b_next_pt,b_next_dir,boundary_curves,k_edge)
                        if dist_to_edge < boundary_tolerance:
                            # We consider that "off" or "too close" => stop
                            print(f"PSL forward reached boundary.")
                            backward_active = False
                            bridging_line = rg.Line(
                                    backward_line[-1],
                                    rg.Point3d(cp)
                            )
                            bridging_lines.append(bridging_line)





                    if backward_active:
                        backward_line.append(rg.Point3d(*b_next_pt))
                        b_current_pt = b_next_pt
                        b_current_dir = b_next_dir

            # --------------------------------------------------
            # If BOTH directions are inactive => stop
            # --------------------------------------------------
            if not forward_active and not backward_active:
                print("Both directions inactive => done.")
                break

            # --------------------------------------------------
            # TIP DISTANCE CHECK
            # (only if both are active)
            # --------------------------------------------------
            if forward_active and backward_active and step_i >= 10:
                f_tip = [forward_line[-1].X, forward_line[-1].Y, forward_line[-1].Z]
                b_tip = [backward_line[-1].X, backward_line[-1].Y, backward_line[-1].Z]
                dist_fb = sqrt(
                    (f_tip[0] - b_tip[0])**2 +
                    (f_tip[1] - b_tip[1])**2 +
                    (f_tip[2] - b_tip[2])**2
                )
                if dist_fb < closing_threshold:
                    # bridging line if you like
                    bridging_line = [forward_line[-1], backward_line[-1]]
                    bridging_lines.append(bridging_line)

                    print(
                        f"PSL tips meet at iteration {step_i}, dist= {dist_fb:.3f} < {closing_threshold}."
                    )
                    forward_active = False
                    backward_active = False
                    break

        # MERGE
        backward_line.reverse()
        if len(backward_line) > 1:
            backward_line.pop()
        merged_pts = backward_line + forward_line

        return merged_pts, bridging_lines, merge_points


    # ------------------------------------------------------------------------
    # "MAIN" LOGIC IN GRASSHOPPER
    # ------------------------------------------------------------------------
    # Below is just an example of how you'd use these functions in GH:
    #   1) Build the 3D KDTree from your data.
    #   2) Loop over seed points.
    #   3) Keep a global 'existing_trajectories' for collisions.
    # ------------------------------------------------------------------------

    # Example usage in a GH Python component:

    # 1) Convert your input points/vectors to lists of [x,y,z].
    points_array_3d = [to_xyz(pt) for pt in points]
    vectors_array_3d = [to_xyz(vec) for vec in principal_vectors]




    sampled_boundary_pts = []
    for crv in boundary_curves:
        params = crv.DivideByCount(sample_count, True)
        for t in params:
            p = crv.PointAt(t)
            sampled_boundary_pts.append([p.X, p.Y, p.Z])

    # Build KDTree for boundary points
    if sampled_boundary_pts:
        boundary_points_array = np.array(sampled_boundary_pts, dtype=float)
        #print(boundary_points_array)
        boundary_kdtree = KDTree(boundary_points_array)
        #print(boundary_kdtree)
    else:
        boundary_kdtree = None
        



    # 2) Build a 3D KD-tree
    points_np = np.array(points_array_3d)  # shape (N, 3)
    #print(points_np)
    kd_tree = KDTree(points_np)
    #print(f"old_kdTree = {kd_tree}")

    # 3) We'll store PSL results in 'existing_trajectories' as: ( [pt3d_list], polyline_curve )
    existing_trajectories = []
    bridging_lines_out = []
    existing_merge_pts = []
    psl_out = []



    # 4) Loop over seed points (3D)
    for seed in seed_points:
        seed_xyz = to_xyz(seed)
        
        merged_psl,  new_bridges, merge_points = trace_psl_both_directions_in_one_loop_3d(
            seed_point_3d=seed_xyz,
            h=h,
            num_steps=num_steps,
            k=k,
            principal_vectors=vectors_array_3d,
            points_3d=points_array_3d,
            kd_tree=kd_tree,
            boundary_curves=boundary_curves,
            boundary_tolerance=boundary_tolerance,
            existing_trajectories=existing_trajectories,
            collision_threshold=collision_threshold,
            closing_threshold=closing_threshold,  
            existing_merge_pts = existing_merge_pts
        )
        
        # Build the cached polyline for collisions
        psl_curve_3d = build_polyline_curve_3d([[pt.X, pt.Y, pt.Z] for pt in merged_psl])
        existing_trajectories.append((merged_psl, psl_curve_3d))
        existing_merge_pts.append(merge_points)

        psl_out.append(psl_curve_3d)
        bridging_lines_out.extend(new_bridges)
        

    # 5) Output
    main_lines = tr.list_to_tree(psl_out)  
    connections = tr.list_to_tree(bridging_lines_out)

    return main_lines, connections





#BASIC
h = 0.5                     #step length
num_steps=400               #Iterations
k=15                        #Interpolation amount
collision_threshold=1       #distance constraint
merge_radius = 5            #snapping radius
n_back = 5                  #Steps back when merging
sample_count = 500          #Sampling boundaries for connection with bridge
k_edge = 30                 #edge connection considerations


seed_points = aa
principal_vectors = bb
points = cc
domain_surface = dd
boundary_curves = ee


a,b = main(h,num_steps,k,collision_threshold,merge_radius,n_back,sample_count,k_edge,seed_points,principal_vectors,points,domain_surface,boundary_curves)
# ---------- end tracer_manual_3d_self ----------
lng_2 = ListLength(List=pt_2)
tracer_automatic_3d_self_single_loop_for = Python3Script(
    seed_point=project_5.Point,
    principal_vectors=shellvecresults_2.FirstPrincipalStressVector_kN_cm²,
    points=shellvecresults_2.Points,
    domain_surface=msh2psrf_2,
    collision_threshold="2",
    boundary_curves=explode_4.Segments,
    stress_values=s_forces_2.FirstPrincipalNormalForce_kN_m)  # -> out, a, b, w, Error_message, c, warning; "Tracer_automatic_3d_self_single_loop_force"; inputs seed_point: list of Point3d, principal_vectors: list of Vector3d, points: list of Point3d, domain_surface: Brep, collision_threshold: Double, boundary_curves: list of Curve, stress_values: list of Double
# ---------- tracer_automatic_3d_self_single_loop_for: Python ----------
def main(ghenv,h,num_steps,k,collision_threshold,snap_radius,n_back,max_offset_distance,sample_interval,sample_count,ratio_minseed_coll,seed_point,principal_vectors,points,domain_surface,boundary_curves,strength,stress_values):

    import math
    import numpy as np
    import rhinoscriptsyntax as rs
    import Rhino.Geometry as rg
    import scriptcontext as sc
    from scipy.spatial import KDTree
    import heapq
    from ghpythonlib import treehelpers as tr


    # ------------------------------------------------------------------------
    # Variables
    # ------------------------------------------------------------------------




    # #BASIC
    # h = 0.4
    # num_steps = 1000
    # k = 15
    # collision_threshold = 1.0
    # offset_distance = 3
    # steps_back = 5


    boundary_tolerance = h
    min_seed_distance = collision_threshold * ratio_minseed_coll
    seed_boundary_dist = min_seed_distance
    closing_threshold=h*10

    # #ADVANCED
    # sample_count = 300
    # min_seed_distance = 2.2 #collision_threshold * 1.5
    # seed_boundary_dist = min_seed_distance
    # sample_interval = 2
    # closing_threshold=0.25

    # ------------------------------------------------------------------------
    # Helper functions
    # ------------------------------------------------------------------------
    def to_xyz(pt_or_vec):
        """Converts Rhino.Geometry.Point3d or Vector3d (or numeric [x,y,z]) to a Python list [x, y, z]."""
        if hasattr(pt_or_vec, "X"):
            return [pt_or_vec.X, pt_or_vec.Y, pt_or_vec.Z]
        else:
            # Already [x,y,z]
            return [pt_or_vec[0], pt_or_vec[1], pt_or_vec[2]]

    def distance_3d(a, b):
        return math.sqrt((a[0]-b[0])**2 + (a[1]-b[1])**2 + (a[2]-b[2])**2)

    def normalize(vector):
        """Normalize a vector (2D) to unit length."""
        magnitude = math.sqrt(vector[0]**2 + vector[1]**2+vector[2]**2)
        return [vector[0] / magnitude, vector[1] / magnitude,vector[2] / magnitude] if magnitude != 0 else [0, 0, 0]

    def to_numeric(vec):
        """Convert a Rhino object to a numeric [x,y,z] list; otherwise return vec as-is."""
        try:
            return [vec.X, vec.Y, vec.Z]
        except AttributeError:
            return vec

    def find_closest_neighbors_kd(point, kd_tree, k):
        """
        Given a 2D point (as [x,y]) and a pre-built KDTree,
        return a list of indices of the k closest points.
        """

        distances, indices = kd_tree.query(point,k=k)
        if isinstance(indices, int):
            return [indices]
        return list(indices)

    def build_polyline_curve_3d(poly_pts):
        pts3d = [rg.Point3d(pt[0], pt[1], pt[2]) for pt in poly_pts]
        poly = rg.Polyline(pts3d)
        return rg.PolylineCurve(poly)

    def project_onto_surface(surface, pt3d, tolerance=200):
        pt_rh = rg.Point3d(pt3d[0], pt3d[1], pt3d[2])
        
        if isinstance(surface, rg.Brep):
            # Note the 6 returned values:
            rc, closest_pt, cindex, u, v, normal = surface.ClosestPoint(pt_rh, tolerance)
            if rc:
                # Check if cindex is a face
                if cindex.ComponentIndexType == rg.ComponentIndexType.BrepFace:
                    face_id = cindex.Index
                    face = surface.Faces[face_id]
                    
                    # 'closest_pt' is the 3D point on that face
                    # Optionally confirm it's within the face domain or do face.IsPointOnFace(u,v)
                    
                    return [closest_pt.X, closest_pt.Y, closest_pt.Z]
                else:
                    # The closest component might be an edge or vertex
                    return None
            else:
                return None
        
        elif isinstance(surface, rg.Surface):
            rc, u, v = surface.ClosestPoint(pt_rh)
            if rc:
                pt_srf = surface.PointAt(u, v)
                return [pt_srf.X, pt_srf.Y, pt_srf.Z]
            else:
                return None
        else:
            return None

    def distance_to_brep_edges(pt3d, boundary_curves):
        test_pt = rg.Point3d(pt3d[0], pt3d[1], pt3d[2])
        min_dist = float('inf')
        best_cp = None  # keep track of the closest point so far
        
        for crv in boundary_curves:
            rc, t = crv.ClosestPoint(test_pt)
            if rc:
                cp = crv.PointAt(t)
                dist = cp.DistanceTo(test_pt)
                if dist < min_dist:
                    min_dist = dist
                    best_cp = cp
        
        return min_dist, best_cp



    def is_on_surface(surface, pt3d, tol=0.01):
        """
        Returns True if pt3d is within 'tol' of the surface. 
        """
        if not surface: 
            return True  # no surface provided
        pproj = project_onto_surface(surface, pt3d)
        if pproj is None:
            return False
        dx = pt3d[0] - pproj[0]
        dy = pt3d[1] - pproj[1]
        dz = pt3d[2] - pproj[2]
        dist = math.sqrt(dx*dx + dy*dy + dz*dz)
        return (dist < tol)



    # ------------------------------------------------------------------------
    # Tracing functions
    # ------------------------------------------------------------------------

    def runge_kutta_step_3d(
        current_point, 
        current_dir,
        h, 
        k, 
        principal_vectors, 
        points_3d, 
        step_sign, 
        kd_tree, 
        boundary_curves=None, 
        boundary_tolerance=1, prev_dir=None):
        """
        Perform one RK4 step in 3D. Stop if next point is within 'boundary_tolerance'
        of any boundary curve (edges).
        Returns the next 3D point or None if out-of-bound / near boundary.
        """
        
        # 1) Neighbors & dynamic step size
        neighbors = find_closest_neighbors_kd(current_point, kd_tree, k)
        h = h * step_sign#adjust_step_size_3d(current_point, neighbors, points_3d, step_sign)
        
        # k1
        k1_dir = interpolate_vector(current_point, points_3d, principal_vectors, neighbors, current_dir)
        mid1 = [
            current_point[0] + 0.5*h*k1_dir[0],
            current_point[1] + 0.5*h*k1_dir[1],
            current_point[2] + 0.5*h*k1_dir[2]
        ]
        
        # k2
        neigh_mid1 = find_closest_neighbors_kd(mid1, kd_tree, k)
        k2_dir = interpolate_vector(mid1, points_3d, principal_vectors, neigh_mid1, k1_dir)
        mid2 = [
            current_point[0] + 0.5*h*k2_dir[0],
            current_point[1] + 0.5*h*k2_dir[1],
            current_point[2] + 0.5*h*k2_dir[2]
        ]
        
        # k3
        neigh_mid2 = find_closest_neighbors_kd(mid2, kd_tree, k)
        k3_dir = interpolate_vector(mid2, points_3d, principal_vectors, neigh_mid2, k2_dir)
        end_pt = [
            current_point[0] + h*k3_dir[0],
            current_point[1] + h*k3_dir[1],
            current_point[2] + h*k3_dir[2]
        ]
        
        # k4
        neigh_end = find_closest_neighbors_kd(end_pt, kd_tree, k)
        k4_dir = interpolate_vector(end_pt, points_3d, principal_vectors, neigh_end, k3_dir)
        
        # Summation
        dx = h*(k1_dir[0] + 2*k2_dir[0] + 2*k3_dir[0] + k4_dir[0]) / 6.0
        dy = h*(k1_dir[1] + 2*k2_dir[1] + 2*k3_dir[1] + k4_dir[1]) / 6.0
        dz = h*(k1_dir[2] + 2*k2_dir[2] + 2*k3_dir[2] + k4_dir[2]) / 6.0
        
        next_point = [
            current_point[0] + dx,
            current_point[1] + dy,
            current_point[2] + dz
        ]
        next_dir = k4_dir

        if domain_surface is not None:
            projected = project_onto_surface(domain_surface, next_point)
            #print(projected)
            if projected is None:
                # Means we're off domain or near an open edge you consider invalid
                return None
            next_point = projected  # accept the projected coordinate

        # 2) Check distance to boundary edges, if we have them
        # if boundary_curves:
        #     dist_to_edge = distance_to_brep_edges(next_point, boundary_curves)
        #     if dist_to_edge < boundary_tolerance:
        #         # We consider that "off" or "too close" => stop
        #         return None

        # Otherwise return the next valid point
        return next_point, next_dir

    def interpolate_vector(point, points, vectors, neighbors, ref_dir):
        """
        Distance-weighted interpolation of neighbor vectors in 3D,
        flipping each neighbor's vector if dot < 0 with respect to 'ref_dir'.

        - pt: [x, y, z], the point where we want the interpolated vector
        - points_3d: Nx3 array of point coords
        - vectors_3d: Nx3 array of principal vectors
        - neighbors: list of indices from the KDTree
        - ref_dir: [dx, dy, dz], the direction from the previous step (or None if first step)
        """
        weights = []
        weighted_vec = [0.0, 0.0, 0.0]

        for i in neighbors:
            vx, vy, vz = vectors[i]  # copy so we can flip locally
            if ref_dir is not None:
                dotp = vx*ref_dir[0] + vy*ref_dir[1] + vz*ref_dir[2]
                if dotp < 0:
                    vx, vy, vz = -vx, -vy, -vz
            
            npt = points[i]
            dx = point[0] - npt[0]
            dy = point[1] - npt[1]
            dz = point[2] - npt[2]
            dist = (dx*dx + dy*dy + dz*dz)**0.5
            
            w = 1.0 / (dist + 1e-6)
            weights.append(w)
            
            weighted_vec[0] += vx*w
            weighted_vec[1] += vy*w
            weighted_vec[2] += vz*w

        total_w = sum(weights)
        if total_w > 1e-12:
            weighted_vec[0] /= total_w
            weighted_vec[1] /= total_w
            weighted_vec[2] /= total_w

        mag = (weighted_vec[0]**2 + weighted_vec[1]**2 + weighted_vec[2]**2)**0.5
        if mag < 1e-12:
            return [0.0, 0.0, 0.0]
        
        return [weighted_vec[0]/mag, weighted_vec[1]/mag, weighted_vec[2]/mag]

    # ------------------------------------------------------------------------
    # Collision checks
    # ------------------------------------------------------------------------


    def closest_point_on_polyline_3d(pt3d, poly_curve):
        """
        Return (closest_point, distance) from a 3D point to a polyline curve.
        """
        test_pt = rg.Point3d(pt3d[0], pt3d[1], pt3d[2])
        rc, t = poly_curve.ClosestPoint(test_pt)
        if rc:
            cp = poly_curve.PointAt(t)
            dist = cp.DistanceTo(test_pt)
            #print(dist)
            return [cp.X, cp.Y, cp.Z], dist
        else:
            return None, float('inf')

    def find_closest_existing_line_3d(next_point, existing_trajectories, threshold):
        """
        Among all previously traced lines (in 3D), find if 'next_point' is within 'threshold' of any line.
        Returns (closest_line_index, closest_point_on_line, distance).
        """
        min_dist = float('inf')
        closest_line_idx = None
        closest_pt = None
        
        for i, (polyline_pts, poly_curve) in enumerate(existing_trajectories):
            cp, dist = closest_point_on_polyline_3d(next_point, poly_curve)
            if dist < min_dist:
                min_dist = dist
                closest_line_idx = i
                closest_pt = cp
        
        if min_dist < threshold:
            return (closest_line_idx, closest_pt, min_dist)
        else:
            return (None, None, float('inf'))

    def find_most_parallel_boundary_point(
        current_pt,
        last_step_vec,
        boundary_points,
        k=10):
        """
        Given a KD-tree of boundary sample points (boundary_kdtree)
        and the original array (boundary_points),
        find the boundary sample whose direction from current_pt 
        is most opposite (or "most parallel" – depends on how you measure) 
        to last_step_vec. Return (best_point, min_dist).

        boundary_points should be a Nx3 np.array or a list of [x,y,z].
        """
        
        if boundary_kdtree is None:
            return None, float('inf')
        
        cur_np = np.array(current_pt, dtype=float)
        step_np = np.array(last_step_vec, dtype=float)
        
        # if zero length, can't define direction
        step_len = np.linalg.norm(step_np)
        if step_len < 1e-12:
            return None, float('inf')
        step_np /= step_len
        
        # 1) Quickly find the 'k' closest boundary samples to current_pt
        #    using the KD-tree:
        #    If k=1, you'll get a single distance & index as floats
        #    If k>1, arrays
        distances, indices = boundary_kdtree.query(cur_np, k=k)

        # If k=1, make them arrays for consistency
        if k == 1:
            distances = [distances]
            indices = [indices]

        # 2) Among these k points, pick the direction which has 
        #    the smallest dot or largest negative dot, etc.
        best_dot = 9999
        best_pt = None
        min_dist = float('inf')

        # boundary_points is Nx3

        for dist, idx in zip(distances, indices):
            cand_np = boundary_points_array[idx]  # shape (3,)
            dir_vec = cand_np - cur_np
            dir_len = np.linalg.norm(dir_vec)
            if dir_len < 1e-12:
                continue
            dir_unit = dir_vec / dir_len
            dot_val = np.dot(dir_unit, step_np)
            
            # Suppose you want the direction that is "most parallel but reversed"
            # => you'd pick the smallest dot_val. If you want "most parallel, same direction,"
            # => you'd pick largest dot_val. 
            if dot_val < best_dot:
                best_dot = dot_val
                best_pt = cand_np
                # optional: track the boundary distance as well
                if dist < min_dist:
                    min_dist = dist

        # Convert best_pt to Rhino point
        if best_pt is not None:
            return rg.Point3d(best_pt[0], best_pt[1], best_pt[2]), min_dist
        else:
            return None, float('inf')

    # ------------------------------------------------------------------------
    # Sampling and offset functions
    # ------------------------------------------------------------------------


    def surface_normal_at_point(surface, pt3d, tolerance=2):
        """
        Returns the surface normal [nx, ny, nz] at a 3D point on a multi-face Brep or rg.Surface.
        If near an open edge or invalid, returns None.
        """
        pt_rh = rg.Point3d(pt3d[0], pt3d[1], pt3d[2])

        if isinstance(surface, rg.Brep):
            stuff = surface.ClosestPoint(pt_rh, tolerance)
            if not stuff or len(stuff) < 6:
                return None
            b = stuff[0]
            rc = stuff[1]
            #print(rc)
            comp_index = stuff[2]
            u = stuff[3]
            v = stuff[4]
            # stuff[4] => cpt
            # stuff[5] => guess_normal
            if not rc:
                return None
            
            # If it's a face, we evaluate the face normal at (u, v)
            if comp_index.ComponentIndexType == rg.ComponentIndexType.BrepFace:
                face_id = comp_index.Index
                face = surface.Faces[face_id]
                exact_normal = face.NormalAt(u, v)
                if exact_normal:
                    return [exact_normal.X, exact_normal.Y, exact_normal.Z]
                else:
                    return None
            else:
                # edge/vertex
                return None
        
        elif isinstance(surface, rg.Surface):
            rc, u, v = surface.ClosestPoint(pt_rh)
            if rc:
                exact_normal = surface.NormalAt(u, v)
                return [exact_normal.X, exact_normal.Y, exact_normal.Z]
            else:
                return None

        # Not a Brep or Surface
        return None

    def offset_seed(psl_pts_3d, index, offset_distance, surface):
        """
        Offsets the PSL at psl_pts_3d[index] in the local tangent plane of 'surface'.
        Steps:
        1) Compute PSL tangent at index
        2) Get surface normal at that point
        3) binormal = cross(surface_normal, psl_tangent)
        4) candidate1 = point + offset_distance*binormal
            candidate2 = point - offset_distance*binormal
        5) (optional) project candidates back onto the surface
        Returns: (candidate1, candidate2) as [x, y, z], or (None, None) on error.
        """
        n = len(psl_pts_3d)
        if n < 2:
            return None, None
        
        # 0) Current point
        px, py, pz = psl_pts_3d[index]
        
        # 1) PSL TANGENT
        if index == 0:
            # Use next point - current point
            nx, ny, nz = psl_pts_3d[1]
            tx = nx - px
            ty = ny - py
            tz = nz - pz
        elif index == n - 1:
            # Use current point - prev point
            px_prev, py_prev, pz_prev = psl_pts_3d[n - 2]
            tx = px - px_prev
            ty = py - py_prev
            tz = pz - pz_prev
        else:
            # Middle: use psl_pts_3d[index+1] - psl_pts_3d[index-1]
            px_prev, py_prev, pz_prev = psl_pts_3d[index - 1]
            px_next, py_next, pz_next = psl_pts_3d[index + 1]
            tx = px_next - px_prev
            ty = py_next - py_prev
            tz = pz_next - pz_prev

        # Normalize tangent
        t_len = math.sqrt(tx*tx + ty*ty + tz*tz)
        if t_len < 1e-12:
            return None, None
        tx /= t_len
        ty /= t_len
        tz /= t_len
        
        # 2) SURFACE NORMAL
        normal = surface_normal_at_point(surface, [px, py, pz])
        if not normal:
            print("no normal")
            return None, None
        nx, ny, nz = normal
        n_len = math.sqrt(nx*nx + ny*ny + nz*nz)
        if n_len < 1e-12:
            return None, None
        nx /= n_len
        ny /= n_len
        nz /= n_len
        
        # 3) BINORMAL = cross(normal, tangent)
        # This is guaranteed to be in the tangent plane if PSL is truly tangent to the surface
        # If the PSL isn't exactly tangent, you'll get some tilt. 
        bx = ny*tz - nz*ty
        by = nz*tx - nx*tz
        bz = nx*ty - ny*tx
        b_len = math.sqrt(bx*bx + by*by + bz*bz)
        if b_len < 1e-12:
            # Means normal and tangent are parallel or something degenerate
            return None, None
        bx /= b_len
        by /= b_len
        bz /= b_len
        
        # 4) OFFSET POINTS
        candidate1 = [px + offset_distance*bx,
                    py + offset_distance*by,
                    pz + offset_distance*bz]
        candidate2 = [px - offset_distance*bx,
                    py - offset_distance*by,
                    pz - offset_distance*bz]
        
        # 5) (OPTIONAL) Project them onto the surface if you want them exactly on the domain
        candidate1_proj = project_onto_surface(surface, candidate1)
        #print(f"this point is seed {candidate1_proj}")
        candidate2_proj = project_onto_surface(surface, candidate2)
        # if not candidate1_proj or not candidate2_proj:
        #     return None, None
        # return candidate1_proj, candidate2_proj

        # If you don't need the final projection, just return them:
        return candidate1_proj, candidate2_proj

    def sample_psl_3d(psl_pts, sample_interval):
        """
        Given a PSL (list of Rhino Point3d or numeric [x,y,z] points),
        sample it every 'sample_interval' points.
        Returns a list of tuples: ( [x,y,z], original_index )
        """
        samples = []
        for i in range(0, len(psl_pts), sample_interval):
            pt3d = psl_pts[i]
            # Convert to numeric [x,y,z] if it's a Point3d
            if hasattr(pt3d, "X"):
                samples.append(([pt3d.X, pt3d.Y, pt3d.Z], i))
            else:
                samples.append((pt3d, i))
        return samples

    def is_valid_seed(candidate, existing_trajectories, min_distance, boundary_curves):
        """
        Check if candidate seed is valid:
        - It is not too close to any existing PSL (using min_distance).
        - It is not too close to any boundary curves (if boundary_curves is provided and
            candidate's distance < boundary_tolerance).
        """
        # Check candidate against existing PSLs
        idx, cp, dist = find_closest_existing_line_3d(candidate, existing_trajectories, min_distance)
        if idx is not None:
            return False

        # Check candidate against boundary curves if provided
        if boundary_curves:
            dist_edge, cp_edge = distance_to_brep_edges(candidate, boundary_curves)
            if dist_edge < seed_boundary_dist:
                return False

        return True

    def get_stress_value(sample_pt, kd_tree, stress_values):
        """
        Query the stress_kdtree to find the nearest stress sample.
        Return the corresponding stress value from stress_values.
        """
        # sample_pt is [x, y] in 2D
        dist, idx = kd_tree.query(sample_pt)  # single neighbor
        # stress_values[idx] is the stress at the nearest stress point
        return stress_values[idx]

    def is_point_close_to_any(point_list, single_point, threshold):
        flat = [item for sublist in point_list for item in sublist]
        #print(f"single = {single_point}")
        single_point_1 = rg.Point3d(single_point[0],single_point[1],single_point[2])
        
        
        for pt in flat:
            #print(f"pt = {pt}")
            if single_point_1.DistanceTo(pt) <= threshold:
                return pt
        return single_point




    # ------------------------------------------------------------------------
    # Tracing logic
    # ------------------------------------------------------------------------

    def trace_psl_both_directions(
        seed_point_3d, 
        h, 
        num_steps, 
        k, 
        principal_vectors, 
        points_3d,
        boundary_curves=None,
        boundary_tolerance=boundary_tolerance,
        existing_trajectories=None,
        collision_threshold=collision_threshold,
        closing_threshold=closing_threshold, 
        kd_tree=None,
        existing_merge_pts = None):
        """
        Single-loop approach where forward/backward can stop independently.
        If forward hits a collision/boundary, it stops, but backward can continue, and vice versa.
        We only stop the entire PSL when BOTH directions are inactive, or when tips meet.
        """
        if existing_trajectories is None:
            existing_trajectories = []
        
        import Rhino.Geometry as rg
        bridging_lines = []
        edge_lines = []
        merge_points = []

        # We'll keep two lines: forward and backward
        forward_line = [rg.Point3d(*seed_point_3d)]
        backward_line = [rg.Point3d(*seed_point_3d)]
        
        # Current forward/backward points + directions
        f_current_pt = list(seed_point_3d)
        f_current_dir = None
        b_current_pt = list(seed_point_3d)
        b_current_dir = None

        # NEW: Boolean flags to track if forward/backward are still active
        forward_active = True
        backward_active = True

        for step_i in range(num_steps):
            
            # ---------------------------
            # FORWARD STEP (if still active)
            # ---------------------------
            if forward_active:
                f_next = runge_kutta_step_3d(
                    f_current_pt,
                    f_current_dir,
                    h,
                    k,
                    principal_vectors,
                    points_3d,
                    step_sign=+1,
                    kd_tree=kd_tree,
                    boundary_curves=boundary_curves,
                    boundary_tolerance=boundary_tolerance
                )
                if not f_next or f_next[0] is None:
                    print(f"PSL forward direction stopped at iteration {step_i}.")
                    forward_active = False
                else:
                    f_next_pt, f_next_dir = f_next
                    # Collision check with existing PSLs
                    if existing_trajectories:
                        line_idx, close_pt, dist_cl = find_closest_existing_line_3d(
                            f_next_pt, existing_trajectories, collision_threshold
                        )

                        if len(existing_merge_pts) > 1 and close_pt is not None:
                            print(f"merged = {merge_points}")
                            close_pt = is_point_close_to_any(existing_merge_pts, close_pt, snap_radius)

                        if line_idx is not None and close_pt is not None:
                            # Instead of break, we do bridging & disable forward
    
                            if len(forward_line) > n_back:
                                bridging_line = rg.Line(
                                    forward_line[-n_back],
                                    rg.Point3d(*close_pt)
                                )
                                bridging_lines.append(bridging_line)
                                merge_points.append(rg.Point3d(*close_pt))
                                del forward_line[-(n_back-1):]

                            if len(forward_line)==0 or len(backward_line)==1:
                                print("too short for bridge")
                            else:
                                bridging_line = rg.Line(
                                    forward_line[-1],
                                    rg.Point3d(*close_pt)
                                )
                                bridging_lines.append(bridging_line)
                                merge_points.append(rg.Point3d(*close_pt))
                            
                            print(f"PSL forward collided with line {line_idx} at dist {dist_cl:.3f}.")
                            forward_active = False

                        # 2) Check distance to boundary edges, if we have them
                    if boundary_curves:
                        dir_vec = [-1*x for x in f_next_dir]
                        cp,dist_to_edge = find_most_parallel_boundary_point(f_next_pt,dir_vec,boundary_curves,10)
                        if dist_to_edge < boundary_tolerance:
                            # We consider that "off" or "too close" => stop
                            print(f"PSL forward reached boundary.")
                            forward_active = False
                            bridging_line = rg.Line(
                                    forward_line[-1],
                                    rg.Point3d(cp)
                            )
                            bridging_lines.append(bridging_line)

                    # If still active, accept the new forward step
                    if forward_active:
                        forward_line.append(rg.Point3d(*f_next_pt))
                        f_current_pt = f_next_pt
                        f_current_dir = f_next_dir

            # ---------------------------
            # BACKWARD STEP (if still active)
            # ---------------------------
            if backward_active:
                b_next = runge_kutta_step_3d(
                    b_current_pt,
                    b_current_dir,
                    h,
                    k,
                    principal_vectors,
                    points_3d,
                    step_sign=-1,
                    kd_tree=kd_tree,
                    boundary_curves=boundary_curves,
                    boundary_tolerance=boundary_tolerance
                )
                if not b_next or b_next[0] is None:
                    print(f"PSL backward direction stopped at iteration {step_i}.")
                    backward_active = False
                else:
                    b_next_pt, b_next_dir = b_next
                    # Collision check with existing PSLs
                    if existing_trajectories:
                        line_idx, close_pt, dist_cl = find_closest_existing_line_3d(
                            b_next_pt, existing_trajectories, collision_threshold
                        )

                        if len(existing_merge_pts) > 1 and close_pt is not None:
                            print(f"merged = {merge_points}")
                            close_pt = is_point_close_to_any(existing_merge_pts, close_pt, snap_radius)


                        if line_idx is not None and close_pt is not None:
                        
                            if len(backward_line) > n_back:
                                bridging_line = rg.Line(
                                    backward_line[-n_back],
                                    rg.Point3d(*close_pt)
                                )
                                bridging_lines.append(bridging_line)
                                merge_points.append(rg.Point3d(*close_pt))
                                del backward_line[-(n_back-1):]

                            if len(backward_line)==0 or len(backward_line)==1:
                                print("too short for bridge")
                            else:
                                bridging_line = rg.Line(
                                    backward_line[-1],
                                    rg.Point3d(*close_pt)
                                )
                                bridging_lines.append(bridging_line)
                                merge_points.append(rg.Point3d(*close_pt))

                            print(f"PSL backward collided with line {line_idx} at dist {dist_cl:.3f}.")
                            backward_active = False


                    if boundary_curves:
                        cp,dist_to_edge = find_most_parallel_boundary_point(b_next_pt,b_next_dir,boundary_curves,10)
                        if dist_to_edge < boundary_tolerance:
                            # We consider that "off" or "too close" => stop
                            print(f"PSL forward reached boundary.")
                            backward_active = False
                            bridging_line = rg.Line(
                                    backward_line[-1],
                                    rg.Point3d(cp)
                            )
                            bridging_lines.append(bridging_line)

                    # If still active, accept the new backward step
                    if backward_active:
                        backward_line.append(rg.Point3d(*b_next_pt))
                        b_current_pt = b_next_pt
                        b_current_dir = b_next_dir
            
            # ---------------------------
            # Check if BOTH directions are done
            # ---------------------------
            if not forward_active and not backward_active:
                print("Both forward & backward directions inactive => stopping PSL.")
                break

            # ---------------------------
            # TIP DISTANCE CHECK
            # ---------------------------
            # Only if both are still active
            if forward_active and backward_active and step_i >= 10:
                f_xyz = [forward_line[-1].X, forward_line[-1].Y, forward_line[-1].Z]
                b_xyz = [backward_line[-1].X, backward_line[-1].Y, backward_line[-1].Z]
                dist_fb = distance_3d(f_xyz, b_xyz)
                if dist_fb < closing_threshold:
                    bridging_line = rg.Line(
                        forward_line[-1],
                        backward_line[-1]
                    )
                    bridging_lines.append(bridging_line)

                    print(
                        f"PSL tips meet at iteration {step_i}, dist= {dist_fb:.3f} < {closing_threshold}."
                    )
                    # Disable both directions and break
                    forward_active = False
                    backward_active = False
                    break
        
        # Merge lines
        backward_line.reverse()
        if len(backward_line) > 1:
            backward_line.pop()
        merged_pts = backward_line + forward_line
        
        return merged_pts, bridging_lines, edge_lines, merge_points




    def generate_all_psls_3d(
        initial_seed_3d,
        h, 
        num_steps, 
        k, 
        principal_vectors, 
        points_3d,
        kd_tree,
        boundary_curves,
        collision_threshold,
        sample_interval,
        min_seed_distance,
        # NEW: for stress-based offset
        stress_values):
        """
        Generate PSLs using an iterative seeding strategy (3D version)
        with a GLOBAL PRIORITY QUEUE for candidate seeds based on stress.

        1) Trace an initial PSL from initial_seed_3d.
        2) Sample it, pushing candidate seeds into a priority queue (max stress first).
        3) Pop the highest-stress seed, validate it, trace a PSL, sample it, push new seeds...
        4) Stop when the priority queue is empty.

        Returns:
        - all_psls: list of (psl_points_3d, polyline_curve_3d)
        - bridging_lines: bridging segments
        - positive_candidates: seeds that were actually used
        """
        existing_merge_pts = []

        # 1) Trace the initial PSL
        initial_psl, initial_bridges, initial_edges, merge_points = trace_psl_both_directions(
            seed_point_3d=initial_seed_3d,
            h=h,
            num_steps=num_steps,
            k=k,
            principal_vectors=principal_vectors,
            points_3d=points_3d,
            boundary_curves=boundary_curves,
            boundary_tolerance=boundary_tolerance,
            existing_trajectories=None,
            collision_threshold=collision_threshold,
            kd_tree=kd_tree,
            existing_merge_pts = existing_merge_pts
        )
        # Convert to curve for collision checks
        initial_curve = build_polyline_curve_3d(initial_psl)

        all_psls = [(initial_psl, initial_curve)]
        bridging_lines = []
        positive_candidates = []
        edges = []
        offsets = []


        if initial_bridges:
            bridging_lines.extend(initial_bridges)

        if initial_edges:
            edges.extend(initial_edges)

        # Helper: sample a PSL, push seeds to a global priority queue
        def add_candidates_from_psl(psl_points, sample_interval):
            samples = sample_psl_3d(psl_points, sample_interval)  # => [ ([x,y,z], index), ... ]
            print(len(samples))
            psl_numeric = [[pt.X, pt.Y, pt.Z] for pt in psl_points]

            for (sample_pt_3d, orig_index) in samples:
                # 1) Query stress
                stress_val = get_stress_value(sample_pt_3d,kd_tree, stress_values)
                # 2) Compute dynamic offset e.g. offset = bar_capacity / stress_val, clamped
                if stress_val < 1e-6:
                    continue
                raw_offset = strength / stress_val
                #print(raw_offset)
                

                dyn_offset = min(raw_offset, max_offset_distance) 
                #print(f"dyn_offset: {dyn_offset}")
                offsets.append(dyn_offset)
                if dyn_offset < collision_threshold:


                    from Grasshopper.Kernel import GH_RuntimeMessageLevel as RML
                    ghenv.Component.AddRuntimeMessage(RML.Warning, "Warning: Needed offset is smaller than collision_threshold -> Choose higher rebar diameter")
                    print("Warning: Needed offset is smaller than collision_threshold -> Choose higher rebar diameter")
                    warning = "Warning: Needed offset is smaller than collision_threshold -> Choose higher rebar diameter"

                # 3) Generate offset candidates
                cand1, cand2 = offset_seed(psl_numeric, orig_index, dyn_offset, domain_surface)
                for c in [cand1, cand2]:
                    if c is not None:
                        # Use negative stress as priority => max stress first
                        heapq.heappush(candidate_queue, (-stress_val, c))
                        
        # 2) Initialize a global priority queue for seeds
        candidate_queue = []
        # Sample the initial PSL, push seeds
        add_candidates_from_psl(initial_psl, sample_interval)

        # 3) Process the global priority queue
        while candidate_queue:
            neg_stress, candidate_3d = heapq.heappop(candidate_queue)
            s_val = -neg_stress
            
            # Check if candidate is valid: 
            #   1) not too close to existing PSLs
            #   2) not too close to domain boundary if you do so in is_valid_seed
            #   3) optionally: on surface, etc.
            if not is_valid_seed(candidate_3d, all_psls, min_seed_distance, boundary_curves):
                continue
            positive_candidates.append(candidate_3d)
            # Now trace a PSL from this candidate
            new_psl, new_bridges, new_edges, merge_points = trace_psl_both_directions(
                seed_point_3d=candidate_3d,
                h=h,
                num_steps=num_steps,
                k=k,
                principal_vectors=principal_vectors,
                points_3d=points_3d,
                boundary_curves=boundary_curves,
                boundary_tolerance=boundary_tolerance,
                existing_trajectories=all_psls,
                collision_threshold=collision_threshold,
                kd_tree=kd_tree,
                existing_merge_pts = existing_merge_pts
            )
            new_curve = build_polyline_curve_3d(new_psl)
            all_psls.append((new_psl, new_curve))
            if new_bridges:
                bridging_lines.extend(new_bridges)

            if new_edges:
                edges.extend(new_edges)
            
            existing_merge_pts.append(merge_points)

            print(f"checkkkkkk = {existing_merge_pts}")

            # Immediately sample the new PSL => add new seeds
            add_candidates_from_psl(new_psl, sample_interval)

        return all_psls, bridging_lines, positive_candidates, edges, offsets


    # ------------------------------------------------------------------------
    # Build KD Trees
    # ------------------------------------------------------------------------

    #1) mesh points kdtree
    points_array_3d = [to_xyz(pt) for pt in points]
    points_np = np.array(points_array_3d)  # shape (N, 3)
    kd_tree = KDTree(points_np)

    #2) boundary sample points kdtree
    sampled_boundary_pts = []
    for crv in boundary_curves:
        params = crv.DivideByCount(sample_count, True)
        for t in params:
            p = crv.PointAt(t)
            sampled_boundary_pts.append([p.X, p.Y, p.Z])

    # Build KDTree for boundary points
    if sampled_boundary_pts:
        boundary_points_array = np.array(sampled_boundary_pts, dtype=float)
        boundary_kdtree = KDTree(boundary_points_array)
    else:
        boundary_kdtree = None







    initial_seed_3d = to_xyz(seed_point[0])
    principal_vectors_3d = [to_xyz(vec) for vec in principal_vectors]








    # ----------------------------------------------------------------------
    # CALL YOUR 3D PSL GENERATION FUNCTION
    # ----------------------------------------------------------------------




    all_psls, bridging_lines, positive_candidates,edges,offsets = generate_all_psls_3d(
        initial_seed_3d,
        h,
        num_steps,
        k,
        principal_vectors_3d,   # 3D vectors
        points_array_3d,        # 3D points
        kd_tree,
        boundary_curves,
        collision_threshold,
        sample_interval,
        min_seed_distance,
        stress_values

    )


    # ----------------------------------------------------------------------
    # PREPARE OUTPUTS FOR GH
    # ----------------------------------------------------------------------
    # 1) PSL polylines as GH curves
    psl_curves = [psl_curve for (psl_points, psl_curve) in all_psls]



    # 3) Convert positive_candidates to Point3d
    generated_seed_points = [rg.Point3d(pc[0], pc[1], pc[2]) for pc in positive_candidates]
    from ghpythonlib import treehelpers as tr
    # 4) Finally set GH outputs (A, B, C, e.g.)
    a = tr.list_to_tree(psl_curves)
    b = tr.list_to_tree(bridging_lines)
    w = tr.list_to_tree(generated_seed_points)
    #c = tr.list_to_tree(offsets)

    return a, b, w




#BASIC
h = 0.4
num_steps = 1000
k = 15


collision_threshold = 1.0
max_offset_distance = 8
n_back = 5
strength = 250
snap_radius = 1

from Grasshopper.Kernel import GH_RuntimeMessageLevel as RML

#ADVANCED
sample_count = 300
ratio_minseed_coll = 1.5
sample_interval = 2



#a, b ,c = main(ghenv,h,num_steps,k,collision_threshold,snap_radius,n_back,max_offset_distance,sample_interval,sample_count,ratio_minseed_coll,seed_point,principal_vectors,points,domain_surface,boundary_curves,strength,stress_values)

from PSL_Tracer import Tracer_C

a, b ,c = Tracer_C.main(ghenv,h,num_steps,k,collision_threshold,snap_radius,n_back,max_offset_distance,sample_interval,sample_count,ratio_minseed_coll,seed_point,principal_vectors,points,domain_surface,boundary_curves,strength,stress_values)
# ---------- end tracer_automatic_3d_self_single_loop_for ----------
shelllineresults_2 = LineResultsOnShellsKaramba3D(
    AnalysedModel=analysethii_2.AnalysedModel,
    LayerPosition=0,
    ListOfSourcesOfPrincipalStressLinesLinesPoints=popgeo_2,
    SegmentLength_m=0.5,
    DA_deg=5,
    mode="PrincStress")  # -> Model, Lines1, Lines2
textdot_3 = DefineTextDot(Text=seq, Location=pt, Font="Arial", Size=14)
list = ValueList({"AngularDimension", "Arc", "Block", "Brep", "Circle", "Curve", "Dimension", "Ellipse", "Extrusion", "Hatch", "Leader", "Line", "LinearDimension", "Mesh", "Point", "Polyline", "Polysurface", "RadialDimension", "Surface", "Text", "TextDot"}, selected="Curve")
crv_9 = Curve(shelllineresults.Lines1)
crv_10 = Curve(shelllineresults.Lines2)
list_2 = ValueList({"AngularDimension", "Arc", "Block", "Brep", "Circle", "Curve", "Dimension", "Ellipse", "Extrusion", "Hatch", "Leader", "Line", "LinearDimension", "Mesh", "Point", "Polyline", "Polysurface", "RadialDimension", "Surface", "Text", "TextDot"}, selected="Curve")
seq_2 = Sequence(Notation="[N-1] + 1", Length=lng_2, Initial=0)
join = JoinCurves(Curves=flatten(crv_10), Preserve=False)
crv_11 = Curve(flatten(tracer_manual_3d_self.a))
crv_12 = Curve(flatten(tracer_automatic_3d_self_single_loop.psl))
crv_13 = Curve(tracer_automatic_3d_self_single_loop.connect)
textdot_4 = DefineTextDot(Text=seq_2, Location=pt_2, Font="Arial", Size=14)
crv_14 = Curve(shelllineresults_2.Lines2)
crv_15 = Curve(shelllineresults_2.Lines1)
crv_16 = Curve(tracer_automatic_3d_self_single_loop_for.b)
crv_17 = Curve(tracer_automatic_3d_self_single_loop_for.a)
divide_3 = DivideCurve(Curve=crv_17, Count=80, Kinks=False)  # -> Points, Tangents, Parameters
pt_3 = Point(tracer_automatic_3d_self_single_loop_for.c)
generated_seeds = Point(tracer_automatic_3d_self_single_loop_for.w)
X = UnitX(Factor=tracer_automatic_3d_self_single_loop_for.c)
filtertype = FilterByType(ObjectType=list, Geometry=crv_11, invertFilter=False, returnNulls=False)  # -> ExcludedGeometry, IncludedGeometry
join_2 = JoinCurves(Curves=flatten(crv_15), Preserve=False)
filtertype_2 = FilterByType(ObjectType=list_2, Geometry=crv_12, invertFilter=False, returnNulls=False)  # -> ExcludedGeometry, IncludedGeometry
join_3 = JoinCurves(Curves=flatten([crv_17, crv_16]), Preserve=False)
crv_18 = Curve(filtertype.IncludedGeometry)
crv_19 = Curve(tracer_manual_3d_self.b)
move = Move(Geometry=divide_3.Points, Motion=expr("x*-1", X))  # -> Geometry, Transform
move_2 = Move(Geometry=divide_3.Points, Motion=X)  # -> Geometry, Transform
crv_20 = Curve(filtertype_2.IncludedGeometry)
import_test_2 = Python3Script(
    aa=flatten(cull_i),
    bb=shellvecresults.SecondPrincipalStressVector_kN_cm²,
    cc=shellvecresults.Points,
    dd=msh2psrf,
    ee=explode_3.Segments)  # -> a, b; inputs aa: list of Point3d, bb: list of Vector3d, cc: list of Point3d, dd: Brep, ee: list of Curve
# ---------- import_test_2: Python ----------
from PSL_Tracer import Tracer_A

#Variables
h = 0.5                     #step length
num_steps=400               #Max Iterations
k=15                        #k nearest neighbours for interpolation
collision_threshold=1       #distance constraint
merge_radius = 5            #snapping radius
n_back = 5                  #Steps back when merging
sample_count = 500          #Sampling boundaries for edge connection
k_edge = 30                 #edge connection considerations

#Geometric input
seed_points = aa
principal_vectors = bb
points = cc
domain_surface = dd
boundary_curves = ee


a,b = Tracer_A.main(h,num_steps,k,collision_threshold,merge_radius,n_back,sample_count,k_edge,seed_points,principal_vectors,points,domain_surface,boundary_curves)
# ---------- end import_test_2 ----------
join_4 = JoinCurves(Curves=flatten([crv_18, crv_19]), Preserve=False)
lng_3 = ListLength(List=generated_seeds)
join_5 = JoinCurves(Curves=flatten([crv_20, crv_13]), Preserve=False)
pdecon = Deconstruct(Point=move_2.Geometry)  # -> XComponent, YComponent, ZComponent
pdecon_2 = Deconstruct(Point=move.Geometry)  # -> XComponent, YComponent, ZComponent
pdecon_3 = Deconstruct(Point=divide_3.Points)  # -> XComponent, YComponent, ZComponent
crv_21 = Curve(flatten(import_test_2.a))
crv_22 = Curve(import_test_2.b)
dom = ConstructDomain(DomainStart=0, DomainEnd=expr("x-1", lng_3))
cir_4 = Circle(Plane=flatten(generated_seeds), Radius=0.5)
pt_4 = ConstructPoint(XCoordinate=pdecon.XComponent, YCoordinate=pdecon.YComponent, ZCoordinate="0")
pt_5 = ConstructPoint(XCoordinate=pdecon_2.XComponent, YCoordinate=pdecon_2.YComponent, ZCoordinate="0")
pt_6 = ConstructPoint(XCoordinate=pdecon_3.XComponent, YCoordinate=pdecon_3.YComponent, ZCoordinate="0")
list_3 = ValueList({"AngularDimension", "Arc", "Block", "Brep", "Circle", "Curve", "Dimension", "Ellipse", "Extrusion", "Hatch", "Leader", "Line", "LinearDimension", "Mesh", "Point", "Polyline", "Polysurface", "RadialDimension", "Surface", "Text", "TextDot"}, selected="Curve")
range = Range(Domain=dom, Steps=expr("x-1", lng_3))
tag = TextTag3D(Location=generated_seeds, Text=range, Size=3, Justification=7)
cull_3 = CullPattern(List=pt_5, CullPattern=[False, True])
cull_4 = CullPattern(List=pt_4, CullPattern=[False, True])
cull_5 = CullPattern(List=pt_6, CullPattern=[False, True])
cir_5 = Circle(Plane=cull_5, Radius="2")
textdot_5 = DefineTextDot(Text=range, Location=generated_seeds, Font="Arial", Size=9)
cir_6 = Circle(Plane=cull_4, Radius="2")
cir_7 = Circle(Plane=cull_3, Radius="2")
sph = Sphere(Base=generated_seeds, Radius=1)
filtertype_3 = FilterByType(ObjectType=list_3, Geometry=crv_21, invertFilter=False, returnNulls=False)  # -> ExcludedGeometry, IncludedGeometry
crv_23 = Curve(filtertype_3.IncludedGeometry)
tracer_manual_3d_self_2 = Python3Script(
    seed_points=flatten(cull_i),
    principal_vectors=shellvecresults.SecondPrincipalStressVector_kN_cm²,
    points=shellvecresults.Points,
    domain_surface=msh2psrf,
    collision_threshold="3",
    boundary_curves=explode_3.Segments,
    run_profile=Toggle(False))  # -> out, a, b, Error_message, c; inputs seed_points: list of Point3d, principal_vectors: list of Vector3d, points: list of Point3d, domain_surface: Brep, collision_threshold: Double, boundary_curves: list of Curve
# ---------- tracer_manual_3d_self_2: Python ----------
import math
import rhinoscriptsyntax as rs
import Rhino
import Rhino.Geometry as rg
import scriptcontext as sc
import numpy as np
from scipy.spatial import KDTree
from ghpythonlib import treehelpers as tr
import cProfile, pstats, io


# ------------------------------------------------------------------------
# Variables
# ------------------------------------------------------------------------

#BASIC
h = 0.5                     #step length
num_steps=400               #Iterations
k=15                        #Interpolation amount
collision_threshold=1
merge_radius = 5



#ADVANCED
n_back = 5                  #Steps back when merging
sample_count = 500          #Sampling boundaries for connection with bridge
k_edge = 30



#set values
tolerance_proj = 2000        #Max distance for projection
boundary_tolerance= h
closing_threshold=h


# ------------------------------------------------------------------------
# 3D UTILITY FUNCTIONS
# ------------------------------------------------------------------------


def get_knn_adjacency(points_3d, k=6):
    """
    Build adjacency by connecting each point to its 'k' nearest neighbors.
    points_3d: Nx3 array (or list) of 3D coords
    Returns: adjacency (list of lists),
            where adjacency[i] is the list of neighbor indices for point i.
    """
    points_np = np.array(points_3d)
    tree = KDTree(points_np)
    adjacency = []

    n = len(points_3d)
    for i in range(n):
        # Query K+1 because the nearest neighbor list includes the point itself at distance 0
        dists, indices = tree.query(points_np[i], k=k+1)
        # Drop 'i' itself
        neighbors = [idx for idx in indices if idx != i]
        adjacency.append(neighbors)
    
    return adjacency


def distance_3d(a, b):
    return math.sqrt((a[0]-b[0])**2 + (a[1]-b[1])**2 + (a[2]-b[2])**2)

def to_xyz(pt_or_vec):
    """Converts Rhino.Geometry.Point3d or Vector3d (or numeric [x,y,z]) to a Python list [x, y, z]."""
    if hasattr(pt_or_vec, "X"):
        return [pt_or_vec.X, pt_or_vec.Y, pt_or_vec.Z]
    else:
        return [pt_or_vec[0], pt_or_vec[1], pt_or_vec[2]]

def normalize_3d(vec):
    """Normalize a 3D vector [x, y, z] to unit length. Returns [0,0,0] if near zero length."""
    mag = math.sqrt(vec[0]**2 + vec[1]**2 + vec[2]**2)
    if mag < 1e-12:
        return [0.0, 0.0, 0.0]
    return [vec[0]/mag, vec[1]/mag, vec[2]/mag]

def find_closest_neighbors_kd_3d(point, kd_tree, k):
    """
    Given a 3D point [x, y, z] and a KDTree, returns a list of indices of the k closest points.
    """
    distances, indices = kd_tree.query(point, k=k)
    if isinstance(indices, int):
        return [indices]
    return list(indices)



# ------------------------------------------------------------------------
# TRACING FUNCTIONS
# ------------------------------------------------------------------------


def interpolate_vector_3d_consistent(pt, points_3d, vectors_3d, neighbors, ref_dir):
    """
    Distance-weighted interpolation of neighbor vectors in 3D,
    flipping each neighbor's vector if dot < 0 with respect to 'ref_dir'.

    - pt: [x, y, z], the point where we want the interpolated vector
    - points_3d: Nx3 array of point coords
    - vectors_3d: Nx3 array of principal vectors
    - neighbors: list of indices from the KDTree
    - ref_dir: [dx, dy, dz], the direction from the previous step (or None if first step)
    """
    weights = []
    weighted_vec = [0.0, 0.0, 0.0]

    for i in neighbors:
        vx, vy, vz = vectors_3d[i]  # copy so we can flip locally
        if ref_dir is not None:
            dotp = vx*ref_dir[0] + vy*ref_dir[1] + vz*ref_dir[2]
            if dotp < 0:
                vx, vy, vz = -vx, -vy, -vz
        
        npt = points_3d[i]
        dx = pt[0] - npt[0]
        dy = pt[1] - npt[1]
        dz = pt[2] - npt[2]
        dist = (dx*dx + dy*dy + dz*dz)**0.5
        
        w = 1.0 / (dist + 1e-6)
        weights.append(w)
        
        weighted_vec[0] += vx*w
        weighted_vec[1] += vy*w
        weighted_vec[2] += vz*w

    total_w = sum(weights)
    if total_w > 1e-12:
        weighted_vec[0] /= total_w
        weighted_vec[1] /= total_w
        weighted_vec[2] /= total_w

    mag = (weighted_vec[0]**2 + weighted_vec[1]**2 + weighted_vec[2]**2)**0.5
    if mag < 1e-12:
        return [0.0, 0.0, 0.0]
    
    return [weighted_vec[0]/mag, weighted_vec[1]/mag, weighted_vec[2]/mag]

def runge_kutta_step_3d(
    current_point, 
    current_dir,
    h, 
    k, 
    principal_vectors, 
    points_3d, 
    step_sign, 
    kd_tree, 
    boundary_curves=None, 
    boundary_tolerance=boundary_tolerance,prev_dir=None):
    """
    Perform one RK4 step in 3D. Stop if next point is within 'boundary_tolerance'
    of any boundary curve (edges).
    Returns the next 3D point or None if out-of-bound / near boundary.
    """
    
    # 1) Neighbors & dynamic step size
    neighbors = find_closest_neighbors_kd_3d(current_point, kd_tree, k)
    h = h * step_sign#adjust_step_size_3d(current_point, neighbors, points_3d, step_sign)
    
    # k1
    k1_dir = interpolate_vector_3d_consistent(current_point, points_3d, principal_vectors, neighbors, current_dir)
    mid1 = [
        current_point[0] + 0.5*h*k1_dir[0],
        current_point[1] + 0.5*h*k1_dir[1],
        current_point[2] + 0.5*h*k1_dir[2]
    ]
    
    # k2
    neigh_mid1 = find_closest_neighbors_kd_3d(mid1, kd_tree, k)
    k2_dir = interpolate_vector_3d_consistent(mid1, points_3d, principal_vectors, neigh_mid1, k1_dir)
    mid2 = [
        current_point[0] + 0.5*h*k2_dir[0],
        current_point[1] + 0.5*h*k2_dir[1],
        current_point[2] + 0.5*h*k2_dir[2]
    ]
    
    # k3
    neigh_mid2 = find_closest_neighbors_kd_3d(mid2, kd_tree, k)
    k3_dir = interpolate_vector_3d_consistent(mid2, points_3d, principal_vectors, neigh_mid2, k2_dir)
    end_pt = [
        current_point[0] + h*k3_dir[0],
        current_point[1] + h*k3_dir[1],
        current_point[2] + h*k3_dir[2]
    ]
    
    # k4
    neigh_end = find_closest_neighbors_kd_3d(end_pt, kd_tree, k)
    k4_dir = interpolate_vector_3d_consistent(end_pt, points_3d, principal_vectors, neigh_end, k3_dir)
    
    # Summation
    dx = h*(k1_dir[0] + 2*k2_dir[0] + 2*k3_dir[0] + k4_dir[0]) / 6.0
    dy = h*(k1_dir[1] + 2*k2_dir[1] + 2*k3_dir[1] + k4_dir[1]) / 6.0
    dz = h*(k1_dir[2] + 2*k2_dir[2] + 2*k3_dir[2] + k4_dir[2]) / 6.0
    
    next_point = [
        current_point[0] + dx,
        current_point[1] + dy,
        current_point[2] + dz
    ]
    next_dir = k4_dir

    if domain_surface is not None:
        projected = project_onto_surface(domain_surface, next_point, tolerance_proj)
        #print(projected)
        if projected is None:
            # Means we're off domain or near an open edge you consider invalid
            return None
        next_point = projected  # accept the projected coordinate


    # Otherwise return the next valid point
    return next_point, next_dir


# ------------------------------------------------------------------------#
# SURFACE / BREP PROJECTION UTILS
# ------------------------------------------------------------------------#

def project_onto_surface(surface, pt3d, tolerance_proj):
    pt_rh = rg.Point3d(pt3d[0], pt3d[1], pt3d[2])
    
    if isinstance(surface, rg.Brep):
        # Note the 6 returned values:
        rc, closest_pt, cindex, u, v, normal = surface.ClosestPoint(pt_rh, tolerance_proj)
        if rc:
            # Check if cindex is a face
            if cindex.ComponentIndexType == rg.ComponentIndexType.BrepFace:
                face_id = cindex.Index
                face = surface.Faces[face_id]
                
                # 'closest_pt' is the 3D point on that face
                # Optionally confirm it's within the face domain or do face.IsPointOnFace(u,v)
                
                return [closest_pt.X, closest_pt.Y, closest_pt.Z]
            else:
                # The closest component might be an edge or vertex
                return None
        else:
            return None
    
    elif isinstance(surface, rg.Surface):
        rc, u, v = surface.ClosestPoint(pt_rh)
        if rc:
            pt_srf = surface.PointAt(u, v)
            return [pt_srf.X, pt_srf.Y, pt_srf.Z]
        else:
            return None
    else:
        return None

def is_on_surface(surface, pt3d, tol=0.01):
    """
    Returns True if pt3d is within 'tol' of the surface. 
    """
    if not surface: 
        return True  # no surface provided
    pproj = project_onto_surface(surface, pt3d)
    if pproj is None:
        return False
    dx = pt3d[0] - pproj[0]
    dy = pt3d[1] - pproj[1]
    dz = pt3d[2] - pproj[2]
    dist = math.sqrt(dx*dx + dy*dy + dz*dz)
    return (dist < tol)



# ------------------------------------------------------------------------
# COLLISION/DISTANCE CHECKS
# ------------------------------------------------------------------------


def build_polyline_curve_3d(poly_pts):
    pts3d = [rg.Point3d(pt[0], pt[1], pt[2]) for pt in poly_pts]
    poly = rg.Polyline(pts3d)
    return rg.PolylineCurve(poly)

def closest_point_on_polyline_3d(pt3d, poly_curve):
    """
    Return (closest_point, distance) from a 3D point to a polyline curve.
    """
    test_pt = rg.Point3d(pt3d[0], pt3d[1], pt3d[2])
    rc, t = poly_curve.ClosestPoint(test_pt)
    if rc:
        cp = poly_curve.PointAt(t)
        dist = cp.DistanceTo(test_pt)
        return [cp.X, cp.Y, cp.Z], dist
    else:
        return None, float('inf')






def find_closest_existing_line_3d(next_point, existing_trajectories, threshold):
    """
    Among all previously traced lines (in 3D), find if 'next_point' is within 'threshold' of any line.
    Returns (closest_line_index, closest_point_on_line, distance).
    """
    min_dist = float('inf')
    closest_line_idx = None
    closest_pt = None
    
    for i, (polyline_pts, poly_curve) in enumerate(existing_trajectories):
        cp, dist = closest_point_on_polyline_3d(next_point, poly_curve)
        if dist < min_dist:
            min_dist = dist
            closest_line_idx = i
            closest_pt = cp
    
    if min_dist < threshold:
        return (closest_line_idx, closest_pt, min_dist)
    else:
        return (None, None, float('inf'))

def is_point_close_to_any(point_list, single_point, threshold):
    flat = [item for sublist in point_list for item in sublist]
    #print(f"single = {single_point}")
    single_point_1 = rg.Point3d(single_point[0],single_point[1],single_point[2])
    
    
    for pt in flat:
        #print(f"pt = {pt}")
        if single_point_1.DistanceTo(pt) <= threshold:
            return pt
    return single_point

def find_most_parallel_boundary_point(
    current_pt,
    last_step_vec,
    boundary_points,
    k=10):
    """
    Given a KD-tree of boundary sample points (boundary_kdtree)
    and the original array (boundary_points),
    find the boundary sample whose direction from current_pt 
    is most opposite (or "most parallel" – depends on how you measure) 
    to last_step_vec. Return (best_point, min_dist).

    boundary_points should be a Nx3 np.array or a list of [x,y,z].
    """
    
    if boundary_kdtree is None:
        return None, float('inf')
    
    cur_np = np.array(current_pt, dtype=float)
    step_np = np.array(last_step_vec, dtype=float)
    
    # if zero length, can't define direction
    step_len = np.linalg.norm(step_np)
    if step_len < 1e-12:
        return None, float('inf')
    step_np /= step_len
    
    # 1) Quickly find the 'k' closest boundary samples to current_pt
    #    using the KD-tree:
    #    If k=1, you'll get a single distance & index as floats
    #    If k>1, arrays
    distances, indices = boundary_kdtree.query(cur_np, k=k)

    # If k=1, make them arrays for consistency
    if k == 1:
        distances = [distances]
        indices = [indices]

    # 2) Among these k points, pick the direction which has 
    #    the smallest dot or largest negative dot, etc.
    best_dot = 9999
    best_pt = None
    min_dist = float('inf')

    # boundary_points is Nx3

    for dist, idx in zip(distances, indices):
        cand_np = boundary_points_array[idx]  # shape (3,)
        dir_vec = cand_np - cur_np
        dir_len = np.linalg.norm(dir_vec)
        if dir_len < 1e-12:
            continue
        dir_unit = dir_vec / dir_len
        dot_val = np.dot(dir_unit, step_np)
        
        # Suppose you want the direction that is "most parallel but reversed"
        # => you'd pick the smallest dot_val. If you want "most parallel, same direction,"
        # => you'd pick largest dot_val. 
        if dot_val < best_dot:
            best_dot = dot_val
            best_pt = cand_np
            # optional: track the boundary distance as well
            if dist < min_dist:
                min_dist = dist

    # Convert best_pt to Rhino point
    if best_pt is not None:
        return rg.Point3d(best_pt[0], best_pt[1], best_pt[2]), min_dist
    else:
        return None, float('inf')


# ------------------------------------------------------------------------
# TRACE PSL IN BOTH DIRECTIONS (3D)
# ------------------------------------------------------------------------               


def trace_psl_both_directions_in_one_loop_3d(
    seed_point_3d,
    h, 
    num_steps,
    k,
    principal_vectors, 
    points_3d,
    kd_tree,
    boundary_curves=None,
    boundary_tolerance=boundary_tolerance,
    existing_trajectories=None,
    collision_threshold=collision_threshold,
    closing_threshold=closing_threshold,
    existing_merge_pts = None):
    """
    Traces a PSL forward (+1) and backward (-1) in ONE loop, letting each direction
    stop or collide independently. If forward is done, backward can keep going (and vice versa).
    If both are done, or tips meet, we stop entirely.
    """
    if existing_trajectories is None:
        existing_trajectories = []
    
    import Rhino.Geometry as rg
    from math import sqrt

    # Initialize lines
    forward_line = [rg.Point3d(*seed_point_3d)]
    backward_line = [rg.Point3d(*seed_point_3d)]

    # Current states
    f_current_pt = list(seed_point_3d)
    f_current_dir = None
    b_current_pt = list(seed_point_3d)
    b_current_dir = None

    bridging_lines = []
    merge_points = []

    # NEW: Flags for forward/backward
    forward_active = True
    backward_active = True

    for step_i in range(num_steps):
        # --------------------------------------------------
        # FORWARD STEP (if still active)
        # --------------------------------------------------
        if forward_active:
            f_next = runge_kutta_step_3d(
                f_current_pt,
                f_current_dir,
                h,
                k,
                principal_vectors,
                points_3d,
                step_sign=+1,
                kd_tree=kd_tree,
                boundary_curves=boundary_curves,
                boundary_tolerance=boundary_tolerance
            )
            if not f_next or (f_next[0] is None):
                print(f"PSL forward direction stopped at iteration {step_i}.")
                # Do NOT break from the entire loop
                forward_active = False
            else:
                # Accept the new point
                f_next_pt, f_next_dir = f_next
                
                # Optional collision check
                if existing_trajectories:
                    line_idx, close_pt, dist_cl = find_closest_existing_line_3d(
                        f_next_pt, existing_trajectories, collision_threshold
                    )
                    if len(existing_merge_pts) > 1 and close_pt is not None:
                        
                        close_pt = is_point_close_to_any(existing_merge_pts, close_pt, merge_radius)

                    if line_idx is not None and close_pt is not None:
                        # Instead of break, we do bridging & disable forward
                        steps_back = n_back
                        if len(forward_line) > steps_back:
                            bridging_line = rg.Line(
                                forward_line[-steps_back],
                                rg.Point3d(*close_pt)
                            )
                            bridging_lines.append(bridging_line)
                            merge_points.append(rg.Point3d(*close_pt))
                            del forward_line[-(steps_back-1):]
                        if len(forward_line)==0:
                            print("too short for bridge")
                        else:
                            bridging_line = rg.Line(
                                forward_line[-1],
                                rg.Point3d(*close_pt)
                            )
                            bridging_lines.append(bridging_line)
                            merge_points.append(rg.Point3d(*close_pt))
                        
                        print(f"PSL forward collided with line {line_idx} at dist {dist_cl:.3f}.")
                        forward_active = False

                    # 2) Check distance to boundary edges, if we have them

                if boundary_curves:
                    dir_vec = [-1*x for x in f_next_dir]
                    cp,dist_to_edge = find_most_parallel_boundary_point(f_next_pt,dir_vec,boundary_curves,k_edge)
                    if dist_to_edge < boundary_tolerance:
                        # We consider that "off" or "too close" => stop
                        print(f"PSL forward reached boundary.")
                        forward_active = False
                        bridging_line = rg.Line(
                                forward_line[-1],
                                rg.Point3d(cp)
                        )
                        bridging_lines.append(bridging_line)
                        
                # If still active after collision checks, append the step
                if forward_active:
                    forward_line.append(rg.Point3d(*f_next_pt))
                    f_current_pt = f_next_pt
                    f_current_dir = f_next_dir

        # --------------------------------------------------
        # BACKWARD STEP (if still active)
        # --------------------------------------------------
        if backward_active:
            b_next = runge_kutta_step_3d(
                b_current_pt,
                b_current_dir,
                h,
                k,
                principal_vectors,
                points_3d,
                step_sign=-1,
                kd_tree=kd_tree,
                boundary_curves=boundary_curves,
                boundary_tolerance=boundary_tolerance
            )
            if not b_next or (b_next[0] is None):
                print(f"PSL backward direction stopped at iteration {step_i}.")
                backward_active = False
            else:
                b_next_pt, b_next_dir = b_next
                
                if existing_trajectories:
                    line_idx, close_pt, dist_cl = find_closest_existing_line_3d(
                        b_next_pt, existing_trajectories, collision_threshold
                    )
                    if len(existing_merge_pts) > 1 and close_pt is not None:
                        close_pt = is_point_close_to_any(existing_merge_pts, close_pt, merge_radius)

                    if line_idx is not None and close_pt is not None:
                        steps_back = n_back
                    
                        if len(backward_line) > steps_back:
                            bridging_line = rg.Line(
                                backward_line[-steps_back],
                                rg.Point3d(*close_pt)
                            )
                            del backward_line[-(steps_back-1):]
                            bridging_lines.append(bridging_line)
                            merge_points.append(rg.Point3d(*close_pt))

                        if len(backward_line)==0:
                            print("too short for bridge")
                        else:
                            bridging_line = rg.Line(
                                backward_line[-1],
                                rg.Point3d(*close_pt)
                            )
                            bridging_lines.append(bridging_line)
                            merge_points.append(rg.Point3d(*close_pt))
                        print(f"PSL backward collided with line {line_idx} at dist {dist_cl:.3f}.")
                        backward_active = False




                #print(f"direction = {b_current_dir}")
                if boundary_curves:
                    cp,dist_to_edge = find_most_parallel_boundary_point(b_next_pt,b_next_dir,boundary_curves,k_edge)
                    if dist_to_edge < boundary_tolerance:
                        # We consider that "off" or "too close" => stop
                        print(f"PSL forward reached boundary.")
                        backward_active = False
                        bridging_line = rg.Line(
                                backward_line[-1],
                                rg.Point3d(cp)
                        )
                        bridging_lines.append(bridging_line)





                if backward_active:
                    backward_line.append(rg.Point3d(*b_next_pt))
                    b_current_pt = b_next_pt
                    b_current_dir = b_next_dir

        # --------------------------------------------------
        # If BOTH directions are inactive => stop
        # --------------------------------------------------
        if not forward_active and not backward_active:
            print("Both directions inactive => done.")
            break

        # --------------------------------------------------
        # TIP DISTANCE CHECK
        # (only if both are active, or up to you)
        # --------------------------------------------------
        if forward_active and backward_active and step_i >= 10:
            f_tip = [forward_line[-1].X, forward_line[-1].Y, forward_line[-1].Z]
            b_tip = [backward_line[-1].X, backward_line[-1].Y, backward_line[-1].Z]
            dist_fb = sqrt(
                (f_tip[0] - b_tip[0])**2 +
                (f_tip[1] - b_tip[1])**2 +
                (f_tip[2] - b_tip[2])**2
            )
            if dist_fb < closing_threshold:
                # bridging line if you like
                bridging_line = [forward_line[-1], backward_line[-1]]
                bridging_lines.append(bridging_line)

                print(
                    f"PSL tips meet at iteration {step_i}, dist= {dist_fb:.3f} < {closing_threshold}."
                )
                forward_active = False
                backward_active = False
                break

    # MERGE
    backward_line.reverse()
    if len(backward_line) > 1:
        backward_line.pop()
    merged_pts = backward_line + forward_line

    return merged_pts, bridging_lines, merge_points


# ------------------------------------------------------------------------
# "MAIN" LOGIC IN GRASSHOPPER
# ------------------------------------------------------------------------
# Below is just an example of how you'd use these functions in GH:
#   1) Build the 3D KDTree from your data.
#   2) Loop over seed points.
#   3) Keep a global 'existing_trajectories' for collisions.
# ------------------------------------------------------------------------

# Example usage in a GH Python component:

# 1) Convert your input points/vectors to lists of [x,y,z].
points_array_3d = [to_xyz(pt) for pt in points]




adjacency = get_knn_adjacency(points_array_3d,k=1)
constant_vectors = principal_vectors
vectors_array_3d = [to_xyz(vec) for vec in constant_vectors]




sampled_boundary_pts = []
for crv in boundary_curves:
    params = crv.DivideByCount(sample_count, True)
    for t in params:
        p = crv.PointAt(t)
        sampled_boundary_pts.append([p.X, p.Y, p.Z])

# Build KDTree for boundary points
if sampled_boundary_pts:
    boundary_points_array = np.array(sampled_boundary_pts, dtype=float)
    #print(boundary_points_array)
    boundary_kdtree = KDTree(boundary_points_array)
    #print(boundary_kdtree)
else:
    boundary_kdtree = None
    



# 2) Build a 3D KD-tree
points_np = np.array(points_array_3d)  # shape (N, 3)
#print(points_np)
kd_tree = KDTree(points_np)
#print(f"old_kdTree = {kd_tree}")

# 3) We'll store PSL results in 'existing_trajectories' as: ( [pt3d_list], polyline_curve )
existing_trajectories = []
bridging_lines_out = []
existing_merge_pts = []



# 4) Loop over seed points (3D)
for seed in seed_points:
    seed_xyz = to_xyz(seed)
    
    merged_psl,  new_bridges, merge_points = trace_psl_both_directions_in_one_loop_3d(
        seed_point_3d=seed_xyz,
        h=h,
        num_steps=num_steps,
        k=k,
        principal_vectors=vectors_array_3d,
        points_3d=points_array_3d,
        kd_tree=kd_tree,
        boundary_curves=boundary_curves,
        boundary_tolerance=boundary_tolerance,
        existing_trajectories=existing_trajectories,
        collision_threshold=collision_threshold,
        closing_threshold=closing_threshold,  
        existing_merge_pts = existing_merge_pts
    )
    
    # Build the cached polyline for collisions
    psl_curve_3d = build_polyline_curve_3d([[pt.X, pt.Y, pt.Z] for pt in merged_psl])
    existing_trajectories.append((merged_psl, psl_curve_3d))
    bridging_lines_out.extend(new_bridges)
    existing_merge_pts.append(merge_points)

# 5) Output
a = tr.list_to_tree(existing_trajectories)  # Each branch: (pts, polylineCurve)
b = tr.list_to_tree(bridging_lines_out)
c = tr.list_to_tree(sampled_boundary_pts)
# ---------- end tracer_manual_3d_self_2 ----------
join_6 = JoinCurves(Curves=flatten([crv_23, crv_22]), Preserve=False)
